# Grasshopper definition 11_10_24.gh (Grasshopper 1.0.8)
# plug-ins: Aggregations, RhinoCodePluginGH, Heteroptera, Pufferfish, Human, MetaHopper, Palette, Telepathy

# ----
# GH COLORS
boolean_toggle = BooleanToggle(True)
palette = Palette(
    ModeCustomStandard=boolean_toggle,
    Component_Normal_Deselected_Fill_Color=ColourSwatch(SwatchColor=RGB(235, 235, 235)),
    Component_Normal_Deselected_Edge_Color=ColourSwatch(SwatchColor=RGB(25, 105, 86)),
    Component_Normal_Deselected_Text_Color=ColourSwatch(SwatchColor=RGB(0, 0, 0)),
    Component_Normal_Selected_Fill_Color=ColourSwatch(SwatchColor=RGB(120, 176, 109)),
    Component_Normal_Selected_Edge_Color=RGB(0, 50, 0),
    Component_Normal_Selected_Text_Color=RGB(0, 25, 0),
    Component_Hidden_Deselected_Fill_Color=ColourSwatch(SwatchColor=RGB(145, 145, 145)),
    Component_Hidden_Deselected_Edge_Color=ColourSwatch(SwatchColor=RGB(0, 0, 0)),
    Component_Hidden_Deselected_Text_Color=ColourSwatch(SwatchColor=RGB(64, 63, 63)),
    Component_Hidden_Selected_Fill_Color=ColourSwatch(SwatchColor=RGB(120, 176, 109)),
    Component_Hidden_Selected_Edge_Color=RGB(0, 35, 0),
    Component_Hidden_Selected_Text_Color=RGB(0, 25, 0),
    Component_Disabled_Deselected_Fill_Color=ColourSwatch(SwatchColor=RGB(156, 81, 81)),
    Component_Disabled_Deselected_Edge_Color=ColourSwatch(SwatchColor=RGB(0, 0, 0)),
    Component_Disabled_Deselected_Text_Color=ColourSwatch(SwatchColor=RGB(227, 227, 227)),
    Component_Disabled_Selected_Fill_Color=ColourSwatch(SwatchColor=RGB(199, 178, 74)),
    Component_Disabled_Selected_Edge_Color=RGB(40, 70, 40),
    Component_Disabled_Selected_Text_Color=RGB(75, 100, 65),
    Component_Warning_Deselected_Fill_Color=RGB(255, 140, 20),
    Component_Warning_Deselected_Edge_Color=RGB(80, 10, 0),
    Component_Warning_Deselected_Text_Color=RGB(0, 0, 0),
    Component_Warning_Selected_Fill_Color=RGB(185, 205, 0),
    Component_Warning_Selected_Edge_Color=RGB(0, 50, 0),
    Component_Warning_Selected_Text_Color=RGB(0, 0, 0),
    Component_Error_Deselected_Fill_Color=RGB(200, 0, 0),
    Component_Error_Deselected_Edge_Color=RGB(60, 0, 0),
    Component_Error_Deselected_Text_Color=RGB(0, 0, 0),
    Component_Error_Selected_Fill_Color=RGB(125, 155, 0),
    Component_Error_Selected_Edge_Color=RGB(0, 50, 0),
    Component_Error_Selected_Text_Color=RGB(255, 255, 255),
    Component_Label_Deselected_Fill_Color=RGB(50, 50, 50),
    Component_Label_Deselected_Edge_Color=RGB(0, 0, 0),
    Component_Label_Deselected_Text_Color=RGB(255, 255, 255),
    Component_Label_Selected_Fill_Color=RGB(25, 60, 25),
    Component_Label_Selected_Edge_Color=RGB(0, 35, 0),
    Component_Label_Selected_Text_Color=RGB(190, 250, 180),
    Galapagos_Deselected_Fill_Color=RGB(255, 0, 125),
    Galapagos_Deselected_Edge_Color=RGB(100, 0, 50),
    Galapagos_Selected_Fill_Color=RGB(160, 210, 30),
    Galapagos_Selected_Edge_Color=RGB(0, 50, 0),
    Wire_Normal_Color=ColourSwatch(SwatchColor=RGB(0, 0, 0)),
    Wire_Empty_Color=RGBA(255, 60, 0, 180),
    Wire_Selected_Start_Color=ColourSwatch(SwatchColor=RGB(126, 224, 52)),
    Wire_Selected_End_Color=ColourSwatch(SwatchColor=RGB(35, 89, 41)),
    Panel_Default_Color=ColourSwatch(SwatchColor=RGB(255, 255, 255)),
    Group_Default_Color=ColourSwatch(SwatchColor=RGB(116, 178, 176)),
    Canvas_Background_Color=ColourSwatch(SwatchColor=RGB(196, 196, 196)),
    Canvas_Gridline_Color=RGBA(0, 0, 0, 30),
    Canvas_Gridline_Width=150,
    Canvas_Gridline_Height=50,
    Canvas_Edge_Color=RGB(0, 0, 0),
    Canvas_Shadow_Color=RGBA(0, 0, 0, 80),
    Canvas_Shadow_Size=30,
    MonochromaticOnOff=Toggle(False),
    Monochromatic_Color=RGB(212, 208, 200))

# ----
# Robot Setup
group_toggle = GroupToggle(ToggleActive=True, ToggleVisible=False)  # disabled

value_list = ValueList({"UR5 A": 0, "UR5 B": 1, "COMAU": 2, "COWORKING": 3}, selected="UR5 A")
value_list_2 = ValueList({"UR5 A": 0, "UR5 B": 1, "COMAU": 2, "COWORKING": 3}, selected="UR5 B")
panel = Panel("""UR5 A
COMAU""")
stream_filter = StreamFilter(Gate=value_list, Stream0="UR5 A", Stream1="UR5 B", Stream2="COMAU", Stream3=panel)
stream_filter_2 = StreamFilter(Gate=value_list_2, Stream0="UR5 A", Stream1="UR5 B", Stream2="COMAU", Stream3=panel)
robot_1 = RemoteSender(stream_filter)
robot_2 = RemoteSender(stream_filter_2)

value_list_3 = ValueList({"UR5 A": 0, "UR5 B": 1, "COMAU": 2, "COWORKING": 3}, selected="COMAU")

dynamic_geometry_pipeline = DynamicGeometryPipeline(
    LayerFilter="Pepino::StartPoint",
    TypeFilter="Point",
    NameFilter="*",
    GroupByLayer=False,
    GroupByType=False,
    IncludeHidden=True,
    IncludeLocked=True,
    enableFullPath=True,
    listenToAttributes=True)
dynamic_geometry_pipeline_2 = DynamicGeometryPipeline(
    LayerFilter="Pepino::RigidPoint",
    TypeFilter="Point",
    NameFilter="*",
    GroupByLayer=False,
    GroupByType=False,
    IncludeHidden=True,
    IncludeLocked=True,
    enableFullPath=True,
    listenToAttributes=True)
dynamic_geometry_pipeline_3 = DynamicGeometryPipeline(
    LayerFilter="Pepino::Full",
    TypeFilter="Curve",
    NameFilter="*",
    GroupByLayer=False,
    GroupByType=False,
    IncludeHidden=True,
    IncludeLocked=True,
    enableFullPath=True,
    listenToAttributes=True)

stream_filter_3 = StreamFilter(Gate=value_list_3, Stream0="UR5 A", Stream1="UR5 B", Stream2="COMAU", Stream3=panel)
robot_3 = RemoteSender(stream_filter_3)

number_slider = Slider(1, range=0..2)

group_toggle_2 = GroupToggle(ToggleActive=True, ToggleVisible=False)  # disabled

# ---- group: start point
point = Point(dynamic_geometry_pipeline)

# ---- group: rigid points
point_2 = Point(dynamic_geometry_pipeline_2)

# ---- group: Full
curve = Curve(dynamic_geometry_pipeline_3)

# ----
scale = Scale(Geometry=point_2, Center=Point(0, 0, 0), Factor=number_slider)  # -> Geometry, Transform
scale_2 = Scale(Geometry=curve, Center=Point(0, 0, 0), Factor=number_slider)  # -> Geometry, Transform
python_3_script = Python3Script(lines=scale_2.Geometry)  # -> P, C, simplify(count), networkx_graph; inputs lines: list of Curve
# ---------- python_3_script: Python ----------
# requirements: networkx
import rhinoscriptsyntax as rs
import Grasshopper as gh
import networkx as nx  # Importing NetworkX

def create_connectivity_graph(lines):
    # Create a list to store unique vertices
    vertices = []
    # Create a dictionary to store connections (graph edges)
    graph = {}
    # Create a dictionary to count edges for each vertex
    edge_counts = {}

    # Create a NetworkX graph
    G = nx.Graph()

    # Loop through all the input lines
    for line in lines:       
        # Get the start and end points of the line (edge)
        start_pt = rs.CurveStartPoint(line)
        end_pt = rs.CurveEndPoint(line)

        # Add start and end points to the vertices list if not already present
        if start_pt not in vertices:
            vertices.append(start_pt)
            graph[len(vertices) - 1] = []  # Initialize the adjacency list for this vertex
            edge_counts[len(vertices) - 1] = 0  # Initialize edge count

        if end_pt not in vertices:
            vertices.append(end_pt)
            graph[len(vertices) - 1] = []  # Initialize the adjacency list for this vertex
            edge_counts[len(vertices) - 1] = 0  # Initialize edge count
        
        # Get indices of start and end points in the vertices list
        start_idx = vertices.index(start_pt)
        end_idx = vertices.index(end_pt)
        
        # Create connectivity graph: adding edges to both vertices
        graph[start_idx].append(end_idx)
        graph[end_idx].append(start_idx)

        # Increment edge count for both vertices
        edge_counts[start_idx] += 1
        edge_counts[end_idx] += 1

        # Add the edge to the NetworkX graph using the point indices
        G.add_edge(start_idx, end_idx)

    # Convert edge counts to a list to match vertex order
    edge_count_list = [edge_counts[i] for i in range(len(vertices))]

    # Create a Grasshopper DataTree for the connectivity graph
    connectivity_tree = gh.DataTree[object]()
    for vertex_idx, connections in graph.items():
        for connection in connections:
            # Add connection to the tree
            connectivity_tree.Add(connection, gh.Kernel.Data.GH_Path(vertex_idx))

    return vertices, connectivity_tree, edge_count_list, G

# Grasshopper inputs
lines = lines  # Input list of lines representing edges

# Create connectivity graph based on input lines
vertices, graph, edge_counts, nx_graph = create_connectivity_graph(lines)

# Output the vertices in the same order as in the connectivity graph
P = vertices            # Vertices
C = graph               # Connectivity graph as a Grasshopper DataTree
count = edge_counts     # Count of edges for each vertex
networkx_graph = nx_graph  # NetworkX graph
# ---------- end python_3_script ----------
closest_point = ClosestPoint(Point=point, Cloud=python_3_script.P)  # -> ClosestPoint, CPIndex, Distance
closest_point_2 = ClosestPoint(Point=scale.Geometry, Cloud=python_3_script.P)  # -> ClosestPoint, CPIndex, Distance
list_length = ListLength(List=python_3_script.P)
duplicate_data = DuplicateData(Data=Toggle(False), Number=list_length, Order=True)
replace_items = ReplaceItems(List=duplicate_data, Item=Toggle(True), Indices=closest_point_2.CPIndex, Wrap=False)
python_3_script_2 = Python3Script(
    graph=python_3_script.networkx_graph,
    rigid_points=replace_items,
    start_point=closest_point.CPIndex,
    global_weight=Slider(0.5, range=0..1),
    local_weight=Slider(0.5, range=0..1),
    connection_weight=Slider(0.8, range=0..1),
    N=Slider(20, range=0..100))  # -> vertex_order, flatten(edge_order), simplify(edge_branches_rhino), flatten(edge_branches_python); inputs rigid_points: list of Boolean, start_point: Int32
# ---------- python_3_script_2: Python ----------
import networkx as nx
import ghpythonlib.treehelpers as th

def iterative_rigid_connection(graph, rigid_points, start_point, distances, global_weight, local_weight, connection_weight, N):
    # Initialize lists to store the sequence of connected vertices and edges
    connection_sequence = []
    edge_addition_sequence = []  # To store the order of edges added to make a point rigid
    edge_branches = []  # To store edges in branches for each new rigid vertex

    # Ensure the starting point is marked as rigid and added to the connection sequence
    if not rigid_points[start_point]:  # Check if the starting point is rigid
        rigid_points[start_point] = True  # Mark it as rigid
        connection_sequence.append(start_point)  # Add to the sequence

    # Function to check if a vertex can be rigid based on its neighbors
    def can_be_rigid(node):
        neighbors = list(graph.neighbors(node))
        rigid_neighbors_count = sum(1 for n in neighbors if rigid_points[n])
        return rigid_neighbors_count >= 3

    # Iteratively find new rigid points, prioritizing based on global, local distances, and connection potential
    step_count = 0  # To track the number of steps
    while True:
        new_found = False  # Flag to track if any new vertices were found
        
        # Get the most recent point that was made rigid (for local distance calculation)
        last_rigid_point = connection_sequence[-1] if connection_sequence else start_point

        # Calculate local distances from the last rigid point
        local_distances = nx.single_source_shortest_path_length(graph, last_rigid_point)
        
        # Create a list of candidate nodes (non-rigid)
        candidates = [node for node in graph.nodes() if not rigid_points[node]]
        
        # Calculate weighted scores for candidates based on global distance, local distance, and connection potential
        candidates_weighted_score = []
        for node in candidates:
            local_distance = local_distances.get(node, float('inf'))
            potential_connections = sum(1 for n in graph.neighbors(node) if rigid_points[n])
            
            # Calculate the weighted score
            score = (
                global_weight * distances[node] + 
                local_weight * local_distance - 
                connection_weight * potential_connections
            )

            candidates_weighted_score.append((node, score))

        # Sort candidates by their weighted score
        candidates_weighted_score.sort(key=lambda x: x[1])

        # Try to find the next rigid point from the sorted candidates
        for node, score in candidates_weighted_score:
            if can_be_rigid(node):
                # Find the neighbors that are rigid to record the edges
                rigid_neighbors = [n for n in graph.neighbors(node) if rigid_points[n]]

                # Update the rigidity list and add to connection sequence
                rigid_points[node] = True
                connection_sequence.append(node)

                # Create a new branch for this rigid vertex
                branch_edges = []

                # Record the edges added to make this point rigid as tuples (neighbor, node)
                for neighbor in rigid_neighbors:
                    edge_addition_sequence.append((neighbor, node))  # Edge from neighbor to current node
                    branch_edges.append((neighbor, node))  # Add the tuple (neighbor, node)

                edge_branches.append(branch_edges)  # Store the branch corresponding to this new rigid vertex

                new_found = True  # A new point was found
                break  # Break out of the loop to check the new state of the system

        # Update global distances every N steps if N > 0
        if new_found and N > 0:
            step_count += 1  # Increment step count
            if step_count % N == 0:
                distances = compute_distances(graph, connection_sequence[-1])  # Update distances from the last added rigid point

        # Break the loop if no new rigid points were found
        if not new_found:
            break

    # Convert edge branches to Rhino Data Tree format using ghpythonlib
    edge_braches_python = edge_branches
    edge_branches_rhino = th.list_to_tree(edge_branches)

    return connection_sequence, edge_addition_sequence, edge_branches_rhino, edge_braches_python

# Compute distances from the start point to all other points in the graph
def compute_distances(graph, start_point_index):
    distances = nx.single_source_shortest_path_length(graph, start_point_index)
    distance_list = [None] * len(graph.nodes())
    for node in graph.nodes():
        distance_list[node] = distances.get(node, float('inf'))  # inf for unreachable nodes
    return distance_list

# Inputs
graph = graph  # The input NetworkX graph
rigid_points = rigid_points  # Boolean list indicating initial rigid points
start_point = start_point  # The starting point index
global_weight = global_weight  # Scalar multiplier for global distance
local_weight = local_weight  # Scalar multiplier for local distance
connection_weight = connection_weight  # Scalar multiplier for potential connections
N = N  # Step interval for updating global distances

# Get the distances from the start point to all other nodes
distances = compute_distances(graph, start_point)

# Find the step-by-step connections and the order of edges added, considering global, local distances, and connection potential
vertex_order, edge_order, edge_branches_rhino, edge_branches_python = iterative_rigid_connection(graph, rigid_points, start_point, distances, global_weight, local_weight, connection_weight, N)

# Outputs
vertex_order = vertex_order  
edge_order = edge_order  # Flat list of edges
edge_branches_rhino = edge_branches_rhino  #Branched edges in Rhino/GH data tree structure
edge_branches_python = edge_branches_python #Branched edges python can interpret
# ---------- end python_3_script_2 ----------

dynamic_geometry_pipeline_4 = DynamicGeometryPipeline(
    LayerFilter="Structure::Lines",
    TypeFilter="Curve",
    NameFilter="*",
    GroupByLayer=False,
    GroupByType=False,
    IncludeHidden=True,
    IncludeLocked=True,
    enableFullPath=True,
    listenToAttributes=True)
dynamic_geometry_pipeline_5 = DynamicGeometryPipeline(
    LayerFilter="Structure::Rigid",
    TypeFilter="Point",
    NameFilter="*",
    GroupByLayer=False,
    GroupByType=False,
    IncludeHidden=True,
    IncludeLocked=True,
    enableFullPath=True,
    listenToAttributes=True)
dynamic_geometry_pipeline_6 = DynamicGeometryPipeline(
    LayerFilter="Structure::Start",
    TypeFilter="Point",
    NameFilter="*",
    GroupByLayer=False,
    GroupByType=False,
    IncludeHidden=True,
    IncludeLocked=True,
    enableFullPath=True,
    listenToAttributes=True)

py3 = Python3Script(
    in_lines=dynamic_geometry_pipeline_4,
    in_rigid_points=dynamic_geometry_pipeline_5,
    in_start_point=dynamic_geometry_pipeline_6)  # -> out, assembly_steps, ordered_nodes; inputs in_lines: list of Line, in_rigid_points: list of Point3d, in_start_point: Point3d
# ---------- py3: Python ----------
import rhinoscriptsyntax as rs
import Grasshopper as gh
import Grasshopper.Kernel as ghk
from Grasshopper.Kernel.Data import GH_Path
import Rhino.Geometry as rg
import networkx as nx
from collections import Counter
import math
import numpy as np
import itertools
from itertools import combinations

class Trussemble:
    def __init__(self, lines, rigid_points, start_point):
        ## inputs
        self.lines = lines
        self.points, self.connection_tree = self.__get_line_connectivity(in_lines)
        self.rigid_points = rigid_points
        self.rigid_indices = self.__get_rigid_point_indices()
        self.start_point = start_point
        ## outputs
        self.graph = self.__turn_tree_to_graph(self.connection_tree)
        self.assembly_steps = gh.DataTree[object]()
        self.processed_nodes = []
    
    def __average_point(self, pt1, pt2, pt3):
            # Calculate the average of the x, y, and z coordinates
            avg_x = (pt1.X + pt2.X + pt3.X) / 3
            avg_y = (pt1.Y + pt2.Y + pt3.Y) / 3
            avg_z = (pt1.Z + pt2.Z + pt3.Z) / 3
            
            # Return the average point as a Point3d
            return rg.Point3d(avg_x, avg_y, avg_z)

    def __get_rigid_point_indices(self):
        rigid_indices = []
        for rigid_point in self.rigid_points:
            min_distance = float('inf')
            rigid_idx = None

            if rigid_point in self.points:
                rigid_indices.append(self.points.index(rigid_point))
            else:
                for i, point in enumerate(self.points):
                    distance = rs.Distance(point,rigid_point)
                    if distance < min_distance:
                        min_distance = distance
                        rigid_idx = i
                        
                rigid_indices.append(rigid_idx)
                    
        return rigid_indices

    def __get_line_connectivity(self, lines):
        """
        Create a connectivity tree from a set of lines and return unique points as Point3d and 
        a Grasshopper data structure containing the connectivity information.

        lines: A list of line objects in Rhino.

        Returns a tuple containing a list of unique Point3d and a GH_Structure for connectivity.
        """
        connectivity_tree = gh.DataTree[object]()
        unique_points = {}  # Use a dictionary to map points to their indices

        # Iterate through each line
        for line_index, line in enumerate(lines):
            # Get the start and end points of the line
            start_point = line.From
            end_point = line.To
            
            # Convert to Point3d objects
            start_point3d = rg.Point3d(start_point.X, start_point.Y, start_point.Z)
            end_point3d = rg.Point3d(end_point.X, end_point.Y, end_point.Z)

            # Add points to the unique points dictionary if they don't already exist
            if start_point3d not in unique_points:
                unique_points[start_point3d] = len(unique_points)
            if end_point3d not in unique_points:
                unique_points[end_point3d] = len(unique_points)
            
            # Get the indices of the start and end points
            start_index = unique_points[start_point3d]
            end_index = unique_points[end_point3d]

            # Append the indices to the connectivity tree
            connectivity_tree.EnsurePath(GH_Path(line_index))  # Create a new branch for the line index
            connectivity_tree.AddRange([start_index, end_index], GH_Path(line_index))

        # Convert unique points to a list of Point3d
        unique_points_list = list(unique_points.keys())

        return unique_points_list, connectivity_tree

    def __can_point_be_rigid(self, node):
        graph = self.graph
        neighbours = list(graph.neighbors(node))
        count = 0
        for neighbour in neighbours:
            if neighbour in self.processed_nodes:
                count += 1

        return count >= 3

    def __turn_tree_to_graph(self, connections_tree):
        ## turns connections tree input into networkx graph, connections should be implemented in python (ideally) without use of heteroptera or proximity 2-d
        list_of_tuples = []

        for i in range(connections_tree.BranchCount):
            branch = connections_tree.Branch(i) 
            
            if len(branch) == 2:
                list_of_tuples.append(tuple(branch))
        
        G = nx.Graph()
        G.add_edges_from(list_of_tuples)
        return G

    def __get_first_move(self): 
        start_point = self.start_point
        rigid_ids = self.rigid_indices
        points = self.points
        graph = self.graph

        min_avg_distance_to_start = float('inf')
        neighbours_to_connect_to = []
        first_supports = None

        def find_common_neighbour_combinations(graph, rigid_points_indices):
            valid_combinations = []
            common_neighbors = []
            
            # Generate all combinations of three nodes from rigid_points
            for comb in combinations(rigid_points_indices, 3):
                # Get neighbors for each node in the combination
                neighbors_1 = set(graph.neighbors(comb[0]))
                neighbors_2 = set(graph.neighbors(comb[1]))
                neighbors_3 = set(graph.neighbors(comb[2]))
                
                # Find common neighbors
                common_neighbor = neighbors_1 & neighbors_2 & neighbors_3
                
                # If there is at least one common neighbor, add the combination to the result
                if common_neighbor:
                    valid_combinations.append(comb)
                    common_neighbors.append(list(common_neighbor)[0])

            return valid_combinations, common_neighbors
                
        starting_three_candidates, common_neighbours = find_common_neighbour_combinations(graph, rigid_ids)

        for i, starting_three in enumerate(starting_three_candidates):
            p1 = points[starting_three[0]]
            p2 = points[starting_three[1]]
            p3 = points[starting_three[2]]

            centre = self.__average_point(p1, p2, p3)

            avg_distance = rs.Distance(start_point, centre)
            if avg_distance < min_avg_distance_to_start:
                min_avg_distance_to_start = avg_distance
                first_supports = starting_three
                neighbours_to_connect_to.append(list([common_neighbours[i]]))

        neighbour_to_connect_to = neighbours_to_connect_to[-1][0]

        self.processed_nodes.extend(first_supports)
        self.processed_nodes.append(neighbour_to_connect_to)
        return list(first_supports), neighbour_to_connect_to

    def __check_edges(self, sub_graph_edges):
        graph = self.graph
        edges_to_add = []

        for node1, node2 in combinations(sub_graph_edges, 2):
            if graph.has_edge(node1, node2):
                edges_to_add.append((node1, node2))

        return edges_to_add

    def __find_unprocessed_neighbors_subgraphs(self):
        graph = self.graph
        processed_nodes = self.processed_nodes
        processed_nodes_set = set(processed_nodes)
        
        # Step 1: Find neighbors of the processed nodes that are not yet processed
        unprocessed_neighbors = set()

        # Get the last processed node and find its neighbors first
        last_node = processed_nodes[-1]
        neighbors_last_node = set(graph.neighbors(last_node))
        unprocessed_neighbors_last_node = neighbors_last_node - processed_nodes_set

        # Find unprocessed neighbors of all other nodes
        for node in processed_nodes_set:
            if node == last_node:
                continue  # Skip the last node as we already processed it
            neighbors = set(graph.neighbors(node))
            unprocessed_neighbors.update(neighbors - processed_nodes_set)

        # Add unprocessed neighbors of the last node to the main unprocessed set
        unprocessed_neighbors.update(unprocessed_neighbors_last_node)

        # Step 2: Create subgraphs by finding connected components
        subgraphs = []
        
        # Subgraph that includes only unprocessed neighbors
        unprocessed_subgraph = graph.subgraph(unprocessed_neighbors)
        
        # Find connected components in the unprocessed subgraph
        for component in nx.connected_components(unprocessed_subgraph):
            subgraphs.append(list(component))
        
        # Step 3: Ensure the subgraph connected to the last node in processed_nodes comes first
        subgraphs_sorted = []
        
        # Subgraph connected to the last processed node
        subgraph_last_node = [comp for comp in subgraphs if any(node in unprocessed_neighbors_last_node for node in comp)]
        
        # Remaining subgraphs (not connected to the last node)
        other_subgraphs = [comp for comp in subgraphs if comp not in subgraph_last_node]
        
        # Sort the final output
        if subgraph_last_node:
            subgraphs_sorted.extend(subgraph_last_node)
        
        subgraphs_sorted.extend(other_subgraphs)

        # Return the sorted subgraphs as a nested list
        return subgraphs_sorted

    def __find_connections(self, node):
        graph = self.graph
        can_connect_to = []
        neighbours = graph.neighbors(node)
        for neighbour in neighbours:
            if neighbour in self.processed_nodes:
                can_connect_to.append(neighbour)
        
        return can_connect_to

    def __distance(self, point1, point2):
        return np.linalg.norm(np.array(point1) - np.array(point2))

    def __sort_rigid_candidates(self, candidates):
        origin = self.processed_nodes[-1]
        points = self.points

        sorted_candidates = []
        remaining_candidates = candidates.copy()
        
        # Find the closest point to the origin first
        current_point = min(remaining_candidates, key=lambda c: rs.Distance(points[origin], points[c]))
        sorted_candidates.append(current_point)
        remaining_candidates.remove(current_point)
        
        # Iteratively find the closest point to the last point in sorted_points
        while remaining_candidates:
            current_point = min(remaining_candidates, key=lambda c: rs.Distance(points[sorted_candidates[-1]], points[c]))
            sorted_candidates.append(current_point)
            remaining_candidates.remove(current_point)
        
        return sorted_candidates

    def __get_sorted_supports(self, candidate, supports):
        support_combinations = list(itertools.combinations([x for x in range(len(supports))], 3))
        score_per_combination = {}
        result_supports = []

        def get_combined_distance_to_supports(supports):
            combined_distance = 1.0

            for i in supports:
                for j in supports:
                    if i != j:
                        combined_distance *= rs.Distance(i,j)    
            return combined_distance

        def triangle_area(rs_pointA, rs_pointB, rs_pointC):

            pointA = [rs_pointA.X, rs_pointA.Y, rs_pointA.Z]
            pointB = [rs_pointB.X, rs_pointB.Y, rs_pointB.Z]
            pointC = [rs_pointC.X, rs_pointC.Y, rs_pointC.Z]

            A = np.array(pointA)
            B = np.array(pointB)
            C = np.array(pointC)

            AB = B - A
            AC = C - A

            cross_product = np.cross(AB, AC)

            area = np.linalg.norm(cross_product) / 2

            return area

        for c in support_combinations:
            supports_list = [supports[c[0]], supports[c[1]], supports[c[2]]]

            combined_distance = float(get_combined_distance_to_supports(supports_list))
            area = float(triangle_area(supports_list[0], supports_list[1], supports_list[2]))
            score = combined_distance * (1.0 / area)
            score_per_combination[c] = score
        
        score_per_combination = dict(sorted(score_per_combination.items(), key=lambda item: item[1]))

        support_combinations = list(score_per_combination.keys())
        for support_combination in support_combinations:
            result_support = list(support_combination)
            for i, support in enumerate(supports):

                if i not in support_combination:
                    result_support.append(i)

                result_supports.append(result_support)
        
        return result_supports[0]

    def __check_if_door(self, support_nodes, load_node):
        support_points = [self.points[x] for x in support_nodes]
        load_point = self.points[load_node]
        combination = []

        def point_plane_distance(plane_pts, test_pt):
            # Extract points A, B, C from plane_pts
            A, B, C = plane_pts
            
            # Create two vectors from the points on the plane
            AB = B - A
            AC = C - A
            
            # Calculate the normal vector to the plane using the cross product
            normal_vector = np.cross(AB, AC)
            
            # Plane equation coefficients: Ax + By + Cz + D = 0
            A_coeff, B_coeff, C_coeff = normal_vector
            D_coeff = -np.dot(normal_vector, A)  # D = -(Ax + By + Cz) at point A
            
            # Coordinates of the test point
            x1, y1, z1 = test_pt
            
            # Calculate the distance from the point to the plane
            numerator = abs(A_coeff * x1 + B_coeff * y1 + C_coeff * z1 + D_coeff)
            denominator = np.linalg.norm(normal_vector)
            
            # Distance formula
            distance = numerator / denominator
            return distance

        def rhino_points_to_numpy(rhino_points):
            # Convert a list of Rhino Point3d objects to a 2D NumPy array
            return np.array([[pt.X, pt.Y, pt.Z] for pt in rhino_points])

        def distance_to_centroid(pts, test_pt):
            # Compute the centroid by averaging the x, y, z coordinates of the three points
            centroid = np.mean(pts, axis=0)
            
            # Compute the Euclidean distance between the test point and the centroid
            distance = np.linalg.norm(test_pt - centroid)
            
            return distance

        def is_door(three_supports, load_point, span_height_ratio = 0.25):
            support_pts = rhino_points_to_numpy(three_supports)
            load_pt = np.array([load_point.X, load_point.Y, load_point.Z])

            plane_pts = [support_pts[0], support_pts[1], load_pt]
            test_pt = support_pts[2]

            distance = point_plane_distance(plane_pts, test_pt)
            effective_span = distance_to_centroid(support_pts, load_pt)

            if distance <= (effective_span * span_height_ratio):
                return True
            else:
                return False

        first_three = support_points[:3]
        if not is_door(first_three, load_point):
            return support_points
        else:
            for comb in combinations(support_points, 3):
                if not is_door(list(comb), load_point):
                    combination.extend(list(comb))
                    missing = [x for x in support_points if x not in list(comb)]
                    if missing:
                        combination.extend(missing)
                    return combination
            return True

    def assemble(self):
        graph = self.graph
        points = self.points
        assembly_steps = self.assembly_steps

        while True:
            if len(self.processed_nodes) == 0:
                first_supports, first_neighbours = self.__get_first_move()
                first_neighbour = first_neighbours
                lines_to_add = []

                for support in first_supports:
                    p1 = points[support]
                    p2 = points[first_neighbour]

                    line = rs.AddLine(p1, p2)
                    lines_to_add.append(line)
                
                missing_edges = self.__check_edges(first_supports)
                for missing_edge in missing_edges:
                    p1 = points[missing_edge[0]]
                    p2 = points[missing_edge[1]]

                    line = rs.AddLine(p1,p2)
                    lines_to_add.append(line)

                path = GH_Path(0)
                assembly_steps.AddRange(lines_to_add, path)

            elif len(self.processed_nodes) < len(points):
                non_rigid_candidates = self.__find_unprocessed_neighbors_subgraphs()[0]
                rigid_candidates = [candidate for candidate in non_rigid_candidates if self.__can_point_be_rigid(candidate)]
                sorted_rigid_candidates = self.__sort_rigid_candidates(rigid_candidates)

                for candidate in sorted_rigid_candidates:
                    lines_to_add = []
                    nodes_to_connect_to = self.__find_connections(candidate)
                    nodes_sorted_indices = self.__get_sorted_supports(points[candidate], [points[x] for x in nodes_to_connect_to])
                    sorted_support_nodes = [nodes_to_connect_to[x] for x in nodes_sorted_indices]

                    ## check if it is door
                    if self.__check_if_door(sorted_support_nodes, candidate) == True:

                        ## if it is and cant be resolved, continue to next candidate
                        continue
                    else:

                        ## if it can be resolved return the ordered supports
                        sorted_support_points = self.__check_if_door(sorted_support_nodes, candidate)

                    for point in sorted_support_points:
                        line = rs.AddLine(points[candidate], point)
                        lines_to_add.append(line)
                        
                    self.processed_nodes.append(candidate)
                    path = GH_Path(assembly_steps.BranchCount)
                    assembly_steps.AddRange(lines_to_add, path)
            else:
                return assembly_steps



my_truss = Trussemble(in_lines, in_rigid_points, in_start_point)
assembly_steps = my_truss.assemble()
processed_nodes = my_truss.processed_nodes
nodes = my_truss.points
processed_points = nodes
ordered_nodes = processed_points
# ---------- end py3 ----------
previewlw = CustomPreviewLineweights(
    Geometry=dynamic_geometry_pipeline_4,
    Shader=ColourSwatch(SwatchColor=RGB(230, 230, 230)),
    Thickness=Slider(0.12, range=0..4),
    Absolute=False)

robot_3_2 = RemoteReceiver(robot_3)
ur5_setup = Python3Script(RobotName=robot_3_2)  # -> out, RobotPosition, X_Axis, Y_Axis, Z_Axis, JointPoints, JointLines, SuccessMessage
# ---------- ur5_setup: Python ----------
import robolink as rl  # RoboDK API
import robodk as rdk
import Rhino.Geometry as rg
import math
import numpy as np

# === Inputs ===
# RobotName: Name of the robot in RoboDK (e.g., "Comau NJ 60-2.2")

# Initialize outputs
RobotPosition = None
X_Axis = None
Y_Axis = None
Z_Axis = None
JointPoints = []
JointLines = []
SuccessMessage = ""

# Scaling factor for unit conversion (if RoboDK is in mm and Rhino in meters, set to 0.001)
scaling_factor = 1.0  # Adjust if necessary, e.g., 0.001 for mm to meters

# Initialize RoboDK connection
RDK = rl.Robolink()

# Get the robot by name
robot = RDK.Item(RobotName, rl.ITEM_TYPE_ROBOT)

if not robot.Valid():
    SuccessMessage = f"Error: Could not find {RobotName} in RoboDK."
else:
    SuccessMessage = f"Connected to {RobotName} in RoboDK."

    # Get the robot's base pose
    robot_base = robot.Parent()
    if robot_base.Valid():
        base_pose = robot_base.Pose()
    else:
        base_pose = rdk.Mat()

    # Fetch the TCP pose
    robot_pose = robot.Pose()
    
    # Extract the translation (position) part from the 4x4 matrix
    tcp_position = robot_pose.Pos()  # This gives us [x, y, z]

    # Apply scaling to the TCP position
    tcp_position = [coord * scaling_factor for coord in tcp_position]

    # Create Rhino point for the TCP position
    RobotPosition = rg.Point3d(tcp_position[0], tcp_position[1], tcp_position[2])

    # Extract orientation vectors (X, Y, Z axes) from the RoboDK matrix
    x_vector = rg.Vector3d(robot_pose[0, 0], robot_pose[1, 0], robot_pose[2, 0])
    y_vector = rg.Vector3d(robot_pose[0, 1], robot_pose[1, 1], robot_pose[2, 1])
    z_vector = rg.Vector3d(robot_pose[0, 2], robot_pose[1, 2], robot_pose[2, 2])

    # Scale vectors for visualization purposes
    scale_factor = 200  # Adjust as needed
    x_vector *= scale_factor
    y_vector *= scale_factor
    z_vector *= scale_factor

    # Create lines representing the robot's TCP axes
    X_Axis = rg.Line(RobotPosition, rg.Point3d(RobotPosition.X + x_vector.X, RobotPosition.Y + x_vector.Y, RobotPosition.Z + x_vector.Z))
    Y_Axis = rg.Line(RobotPosition, rg.Point3d(RobotPosition.X + y_vector.X, RobotPosition.Y + y_vector.Y, RobotPosition.Z + y_vector.Z))
    Z_Axis = rg.Line(RobotPosition, rg.Point3d(RobotPosition.X + z_vector.X, RobotPosition.Y + z_vector.Y, RobotPosition.Z + z_vector.Z))

    # === Inverse Kinematics (Solving for joint positions based on TCP) ===
    # Get current joint angles from RoboDK in degrees and convert to radians
    joints_deg = robot.Joints().list()
    joints_rad = [math.radians(angle) for angle in joints_deg]

    # DH parameters for Comau NJ60-2.2 (in millimeters)
    d1 = 495
    a2 = 650
    a3 = 1350
    d4 = 150
    d5 = 0
    d6 = 200

    alpha = [math.pi/2, 0, 0, math.pi/2, -math.pi/2, 0]
    a = [0, a2, a3, 0, 0, 0]
    d = [d1, 0, 0, d4, d5, d6]

    # Calculate joint positions using the forward kinematics and inverse kinematics approach
    # Initialize the transformation matrix with the TCP pose
    T_tcp = np.array(robot_pose.rows)

    # Backtrack through each joint to calculate the joint positions
    T = np.linalg.inv(T_tcp)  # Inverse of the TCP transformation matrix

    JointPoints = []  # Store the joint positions

    # Loop through each joint (6 joints)
    for i in range(6, 0, -1):
        # DH parameters for the current joint
        ai = a[i - 1]
        alphai = alpha[i - 1]
        di = d[i - 1]

        # Extract the position of the current joint by backtracking through the transformations
        joint_position = T[:3, 3]

        # Apply scaling to match the units in Rhino
        joint_position = joint_position * scaling_factor

        # Add the joint position as a Rhino point
        joint_point = rg.Point3d(joint_position[0], joint_position[1], joint_position[2])
        JointPoints.insert(0, joint_point)  # Add to the list at the front to maintain order

        # Update the transformation matrix for the next joint
        T_joint = np.array([
            [math.cos(joints_rad[i - 1]), -math.sin(joints_rad[i - 1]), 0, ai],
            [math.sin(joints_rad[i - 1]), math.cos(joints_rad[i - 1]), 0, 0],
            [0, 0, 1, di],
            [0, 0, 0, 1]
        ])

        # Backtrack to the next joint
        T = np.dot(T, np.linalg.inv(T_joint))

    # Create lines connecting the joints
    JointLines = []
    for i in range(1, len(JointPoints)):
        line = rg.Line(JointPoints[i - 1], JointPoints[i])
        JointLines.append(line)

    # Optionally, connect the base to the first joint
    if JointPoints:
        base_position = base_pose[:3, 3] * scaling_factor
        base_point = rg.Point3d(base_position[0], base_position[1], base_position[2])
        line = rg.Line(base_point, JointPoints[0])
        JointLines.insert(0, line)

    # Optionally, connect the last joint to the TCP
    if JointPoints and RobotPosition:
        line = rg.Line(JointPoints[-1], RobotPosition)
        JointLines.append(line)
# ---------- end ur5_setup ----------
panel_2 = Panel(ur5_setup.RobotPosition)
panel_3 = Panel(ur5_setup.X_Axis)
panel_4 = Panel(ur5_setup.Y_Axis)
panel_5 = Panel(ur5_setup.Z_Axis)
panel_6 = Panel(ur5_setup.JointLines)
panel_7 = Panel(ur5_setup.SuccessMessage)
panel_8 = Panel(ur5_setup.JointPoints)

number_slider_2 = Slider(4, range=1..820)
assembly_steps = Data(py3.assembly_steps)

tstat = TreeStatistics(Tree=assembly_steps)  # -> Paths, Length, Count
series = Series(Start=0, Step=1, Count=number_slider_2)
item = ListItem(List=tstat.Paths, Index=series, Wrap=True)
branch = TreeBranch(Tree=assembly_steps, Path=item, MaintainPaths=True)

connected = GetConnectedObjects(Objects=number_slider_2)
dom = ConstructDomain(DomainStart=1, DomainEnd=expr("x+1", tstat.Count))
set_slider = SetSliderProperties(Slider=connected, Range=dom, Type=1)

previewlw_2 = CustomPreviewLineweights(Geometry=branch, Shader=ColourSwatch(SwatchColor=RGB(237, 19, 19)), Thickness=Slider(5, range=0..10), Absolute=False)

# ----
# convert data
python_3_script_3 = Python3Script(x_edges=python_3_script_2.edge_branches_python, vertices=python_3_script.P)  # -> out, a, b; inputs x_edges: list, x: list, vertices: list of Point3d
# ---------- python_3_script_3: Python ----------
import rhinoscriptsyntax as rs
from Grasshopper import DataTree
from Grasshopper.Kernel.Data import GH_Path

x_edges = x_edges
vertices = vertices

gh_lines = []

for branches in x_edges:
    gh_branches = []
    for edge in branches:
        # Get the start and end vertices from the current edge tuple
        start_vertex_edges = edge[0]
        end_vertex_edges = edge[1]

        # Create a line from start to end vertex_edges
        line = rs.AddLine(vertices[start_vertex_edges], vertices[end_vertex_edges])
        if line:  # Check if the line was created successfully
           gh_branches.append(line)
    gh_lines.append(gh_branches)


tree = DataTree[object]()

# Loop through the list and add items to branches
for i, sublist in enumerate(gh_lines):
    path = GH_Path(i)  # Create a new path for each branch
    for item in sublist:
        tree.Add(item, path)  # Add each item to the branch

# Output the tree
a = tree
print (gh_lines)
# ---------- end python_3_script_3 ----------
list_item = ListItem(List=python_3_script.P, Index=python_3_script_2.vertex_order, Wrap=True)

# ----
# local picking order
line = Line(python_3_script_3.a)
curve_middle = CurveMiddle(Curve=line)
deconstruct = Deconstruct(Point=curve_middle)  # -> XComponent, YComponent, ZComponent
value_list_4 = ValueList({"bottom": 1, "top": 0}, selected="top")
negative = Negative(Value=deconstruct.ZComponent)
stream_filter_4 = StreamFilter(Gate=value_list_4, Stream0=negative, Stream1=deconstruct.ZComponent)
sort_list = SortList(Keys=stream_filter_4, ValuesLines=line, ValuesMid_points=curve_middle)  # -> Keys, ValuesLines, ValuesMid_points

enumerator = Enumerator(Object=<missing>)  # -> Numbers, Color

# ----
# select group
# midpoints
number_slider_3 = Slider(13, range=0..13)
point_3 = Point(sort_list.ValuesMid_points)
split_list = SplitList(List=flatten(point_3), Index=number_slider_3)  # -> ListA, ListB
split_list_2 = SplitList(List=flatten(sort_list.ValuesLines), Index=number_slider_3)  # -> ListA, ListB
data = Data(split_list.ListA)
data_2 = Data(split_list_2.ListA)

custom_preview_lineweights = CustomPreviewLineweights(Geometry=data_2, Shader=ColourSwatch(SwatchColor=RGB(232, 81, 81)), Thickness=Slider(3, range=0..4), Absolute=False)  # disabled

# ----
# Roof Base
number_slider_4 = Slider(400, range=0..400)
unit_z = UnitZ(Factor=number_slider_4)
curve_2 = Curve(<curve referenced from the Rhino model>)
extrude = Extrude(Base=curve_2, Direction=unit_z)
offset_surface = OffsetSurface(Surface=extrude, Distance=Slider(20, range=0..200), BothSides=Toggle(False), CreateSolid=Toggle(True))
deconstruct_brep = DeconstructBrep(Brep=offset_surface)  # -> flatten(Faces), Edges, Vertices
custom_preview = CustomPreview(Geometry=offset_surface, Material=ColourSwatch(SwatchColor=RGB(255, 255, 255)))
populate_2d = Populate2D(Region=deconstruct_brep.Faces, Count=Slider(67, range=0..100), Seed=1)  # -> flatten(Population)

# ----
# Version 2
group_toggle_3 = GroupToggle(ToggleActive=True, ToggleVisible=False)  # disabled

robot_3_3 = RemoteReceiver(robot_3)

# ----
# Table Points
panel_9 = Panel("20")
tablepoints = Point([<point referenced from the Rhino model> x1386])
unit_z_2 = UnitZ(Factor=panel_9)
unit_z_3 = UnitZ(Factor=Slider(20, range=0..100))

tablepoints_2 = RemoteSender(tablepoints)

tablepoints_3 = RemoteReceiver(tablepoints_2)
linear_array = LinearArray(Geometry=tablepoints_3, Direction=unit_z_2, Count=panel_9)  # -> Geometry, Transform
move = Move(Geometry=tablepoints_2, Motion=unit_z_3)  # -> Geometry, Transform
point_4 = Point(flatten(linear_array.Geometry))
deconstruct_2 = Deconstruct(Point=point_4)  # -> XComponent, YComponent, ZComponent
larger_than = LargerThan(FirstNumber=deconstruct_2.ZComponent, SecondNumber="100")  # -> LargerThan, OrEqualTo
point_list = PointList(Points=move.Geometry, Size=Slider(5, range=1..10))
dispatch = Dispatch(List=point_4, DispatchPattern=larger_than.LargerThan)  # -> ListA, ListB
point_5 = Point(dispatch.ListA)
point_list_2 = PointList(Points=point_5, Size=Slider(5, range=5..10))  # disabled

tablepoints_4 = RemoteReceiver(tablepoints_2)
data_dam = DataDam(DataDataA=Slider(26, range=0..1385), BufferDelay=10000000, BufferMode=0)
data_dam_2 = DataDam(DataDataA=Slider(-90, range=-360..360), BufferDelay=10000000, BufferMode=0)
data_dam_3 = DataDam(DataDataA=Slider(549, range=0..1385), BufferDelay=10000000, BufferMode=0)
data_dam_4 = DataDam(DataDataA=Slider(90, range=-360..360), BufferDelay=10000000, BufferMode=0)
data_dam_5 = DataDam(DataDataA=Slider(549, range=0..1385), BufferDelay=10000000, BufferMode=0)
data_dam_6 = DataDam(DataDataA=Slider(90, range=-360..360), BufferDelay=10000000, BufferMode=0)
deconstruct_3 = Deconstruct(Point=tablepoints_4)  # -> XComponent, YComponent, ZComponent
robot_1_2 = RemoteReceiver(robot_1)
robot_2_2 = RemoteReceiver(robot_2)
robot_3_4 = RemoteReceiver(robot_3)
concatenate = Concatenate(
    FragmentA="{",
    FragmentB=deconstruct_3.XComponent,
    FragmentA_2=",",
    FragmentB_2=deconstruct_3.YComponent,
    FragmentA_3=",",
    FragmentA_4=deconstruct_3.ZComponent,
    FragmentA_5="}")  # -> flatten(Result)
python_3_script_4 = Python3Script(TablePoints=concatenate, RobotName=robot_1_2, PointIndex=data_dam, SetBase=Toggle(True), RotationZ=data_dam_2)  # -> out, BasePosition, SuccessMessage; inputs TablePoints: list of Point3d, PointIndex: Int32, RotationZ: Double
# ---------- python_3_script_4: Python ----------
import robolink as rl       
import robodk as rdk        
import Rhino.Geometry as rg 
import math                 
SuccessMessage = ""   
BasePosition = ""     
JointPoints = []      
JointLines = []       


RDK = rl.Robolink()
robot = RDK.Item(RobotName, rl.ITEM_TYPE_ROBOT)
if not robot.Valid():
    
    SuccessMessage = f"Error: Could not find robot '{RobotName}' in RoboDK."
else:
    
    SuccessMessage = f"Connected to robot '{RobotName}' in RoboDK."

    
    if PointIndex >= len(TablePoints) or PointIndex < 0:
        SuccessMessage = f"Error: Point index {PointIndex} is out of bounds."
    else:
        
        point = TablePoints[PointIndex]
        
        
        x = float(point.X)
        y = float(point.Y)
        z = float(point.Z)
        
        
        if SetBase:
           

            
            rz_deg = RotationZ  

            
            rz_rad = math.radians(rz_deg)

           
            rotation_matrix = rdk.rotz(rz_rad)

           
            translation_matrix = rdk.transl(x, y, z)

            
            base_pose = translation_matrix * rotation_matrix

            # === End of Code for RotationZ ===

            # Get the robot's base (parent item in RoboDK)
            robot_base = robot.Parent()

            # Check if robot base is valid before setting pose
            if robot_base.Valid():
                # Set the robot base pose in RoboDK
                robot_base.setPose(base_pose)

                
                BasePosition = f"Base set at: X={x}, Y={y}, Z={z}, RotationZ={rz_deg} degrees"
                SuccessMessage = f"Robot '{RobotName}' base set at Point {PointIndex} with RotationZ={rz_deg} degrees successfully."
            else:
                
                SuccessMessage = "Error: Could not find or access the robot base."
                BasePosition = ""
        else:
            
            robot_base = robot.Parent()
            if robot_base.Valid():
                
                current_base_pose = robot_base.Pose()
                # Extract the translation components (position)
                current_position = current_base_pose.Pos()
                # Extract rotation angles around X, Y, Z axes (in radians)
                rx_rad, ry_rad, rz_rad = rdk.pose_2_xyzrpy(current_base_pose)[3:]  # Angles in radians
                # Convert rotation around Z-axis from radians to degrees
                rz_deg = math.degrees(rz_rad)
                # Update the BasePosition output with current position and rotation
                BasePosition = f"Current base position: X={current_position[0]}, Y={current_position[1]}, Z={current_position[2]}, RotationZ={rz_deg} degrees"
            else:
                # If robot base is not valid, update the BasePosition output
                BasePosition = "Error: Could not retrieve base position."
# ---------- end python_3_script_4 ----------
python_3_script_5 = Python3Script(TablePoints=concatenate, RobotName=robot_2_2, PointIndex=data_dam_3, SetBase=Toggle(False), RotationZ=data_dam_4)  # -> out, BasePosition, SuccessMessage; inputs TablePoints: list of Point3d, PointIndex: Int32, RotationZ: Double; same code as python_3_script_4
python_3_script_6 = Python3Script(TablePoints=concatenate, RobotName=robot_3_4, PointIndex=data_dam_5, SetBase=Toggle(False), RotationZ=data_dam_6)  # -> out, BasePosition, SuccessMessage; inputs TablePoints: list of Point3d, PointIndex: Int32, RotationZ: Double; same code as python_3_script_4
panel_10 = Panel(python_3_script_4.BasePosition)
panel_11 = Panel(python_3_script_4.SuccessMessage)
panel_12 = Panel(python_3_script_5.BasePosition)
panel_13 = Panel(python_3_script_5.SuccessMessage)
panel_14 = Panel(python_3_script_6.BasePosition)
panel_15 = Panel(python_3_script_6.SuccessMessage)

# ----
# Box Demo
number_slider_5 = Slider(71.49, range=0..100)  # disabled
number_slider_6 = Slider(96.62, range=0..100)  # disabled
group_toggle_4 = GroupToggle(ToggleActive=True, ToggleVisible=False)  # disabled
point_6 = Point(<point referenced from the Rhino model>)  # disabled
inputpoint = RemoteSender(point_6)  # disabled
inputpoint_2 = RemoteReceiver(inputpoint)  # disabled
number_slider_7 = Slider(56.44, range=0..100)  # disabled
rectangle = Rectangle(Plane=inputpoint_2, XSize=number_slider_5, YSize=number_slider_6, Radius=0)  # -> Rectangle, Length; disabled
unit_z_4 = UnitZ(Factor=number_slider_7)  # disabled
curve_3 = Curve(rectangle.Rectangle)  # disabled
extrude_2 = Extrude(Base=curve_3, Direction=unit_z_4)  # disabled
cap_holes = CapHoles(Brep=extrude_2)  # disabled
deconstruct_brep_2 = DeconstructBrep(Brep=cap_holes)  # -> Faces, Edges, Vertices; disabled
box = RemoteSender(cap_holes)  # disabled
area = Area(Geometry=deconstruct_brep_2.Faces)  # -> Area, Centroid; disabled
deconstruct_4 = Deconstruct(Point=area.Centroid)  # -> XComponent, YComponent, ZComponent; disabled
sort_list_2 = SortList(Keys=deconstruct_4.ZComponent, ValuesValuesA=deconstruct_brep_2.Faces)  # -> Keys, ValuesValuesA; disabled
number_slider_8 = Slider(34, range=0..64)  # disabled
number_slider_9 = Slider(58, range=0..64)  # disabled
list_item_2 = ListItem(List=sort_list_2.ValuesValuesA, Index=0, Wrap=True)  # disabled
tablepoints_5 = RemoteReceiver(tablepoints_2)  # disabled
area_2 = Area(Geometry=list_item_2)  # -> Area, Centroid; disabled
list_item_3 = ListItem(List=tablepoints_5, Index=number_slider_8, Wrap=True)  # disabled
list_item_4 = ListItem(List=tablepoints_5, Index=number_slider_9, Wrap=True)  # disabled
box_2 = RemoteReceiver(box)  # disabled
move_to_point = MoveToPoint(Geometry=box_2, PointA=area_2.Centroid, PointB=list_item_3)  # -> Moved, Vector, Transform; disabled
move_to_point_2 = MoveToPoint(Geometry=box_2, PointA=area_2.Centroid, PointB=list_item_4)  # -> Moved, Vector, Transform; disabled
box02a = Geometry(move_to_point_2.Moved)  # disabled
box01a = Geometry(move_to_point.Moved)  # disabled
deconstruct_brep_3 = DeconstructBrep(Brep=box01a)  # -> Faces, Edges, Vertices; disabled
area_3 = Area(Geometry=deconstruct_brep_3.Faces)  # -> Area, Centroid; disabled
deconstruct_5 = Deconstruct(Point=area_3.Centroid)  # -> XComponent, YComponent, ZComponent; disabled
number_slider_10 = Slider(511, range=0..909)  # disabled
sort_list_3 = SortList(Keys=deconstruct_5.ZComponent, ValuesValuesA=area_3.Centroid)  # -> Keys, ValuesValuesA; disabled
list_item_5 = ListItem(List=point_5, Index=number_slider_10, Wrap=True)  # disabled
list_item_6 = ListItem(List=reverse(sort_list_3.ValuesValuesA), Index=0, Wrap=True)  # disabled
point_7 = Point(list_item_5)  # disabled
boxtargetpointa = RemoteSender(list_item_6)  # disabled
targeta = RemoteSender(point_7)  # disabled

deconstruct_brep_4 = DeconstructBrep(Brep=box02a)  # -> Faces, Edges, Vertices; disabled
area_4 = Area(Geometry=deconstruct_brep_4.Faces)  # -> Area, Centroid; disabled
deconstruct_6 = Deconstruct(Point=area_4.Centroid)  # -> XComponent, YComponent, ZComponent; disabled
sort_list_4 = SortList(Keys=deconstruct_6.ZComponent, ValuesValuesA=area_4.Centroid)  # -> Keys, ValuesValuesA; disabled
list_item_7 = ListItem(List=reverse(sort_list_4.ValuesValuesA), Index=0, Wrap=True)  # disabled

boxtargetpointb = RemoteSender(list_item_7)  # disabled

# ----
# Version 1
number_slider_11 = Slider(100, range=100..1000)
boxtargetpointb_2 = RemoteReceiver(boxtargetpointb)  # disabled
brep = Brep(<brep referenced from the Rhino model>)
boxtargetpointa_2 = RemoteReceiver(boxtargetpointa)  # disabled
group_toggle_5 = GroupToggle(ToggleActive=True, ToggleVisible=False)  # disabled
deconstruct_brep_5 = DeconstructBrep(Brep=brep)  # -> Faces, Edges, Vertices
targeta_2 = RemoteReceiver(targeta)
populate_2d_2 = Populate2D(Region=deconstruct_brep_5.Faces, Count=number_slider_11, Seed=1)  # -> flatten(Population)
data_dam_7 = DataDam(DataDataA=boxtargetpointa_2, BufferDelay=10000000, BufferMode=0)
sphere = Sphere(Base=targeta_2, Radius="30")
python_3_script_7 = Python3Script(
    RobotName="UR51",
    TargetPoint0=data_dam_7,
    UpdateRoboDK=Toggle(False),
    TargetPointA=targeta_2,
    WorkingTablePoints=populate_2d_2,
    BaseRotationZ="0")  # -> out, SuccessMessage, TCPOrientations, TargetPointCoordinates; inputs TargetPoint0: Point3d, TargetPointA: Point3d, WorkingTablePoints: list of Point3d, BaseRotationZ: Double
# ---------- python_3_script_7: Python ----------
import robolink as rl    # RoboDK API for controlling and communicating with RoboDK
import robodk as rdk     # RoboDK tools, such as matrix operations and other utilities
import Rhino.Geometry as rg
import math

# === Inputs ===
# RobotName: Name of the robot in RoboDK (e.g., "UR5")
# UpdateRoboDK: Boolean toggle to execute the script and update RoboDK when True
# TargetPoint0: The starting point where the robot should move first (Rhino Point3d)
# TargetPointA: The final point where the robot should move and end the program (Rhino Point3d)
# BaseRotationZ: Rotation of the robot's base around the Z-axis in degrees (optional, can be 0 if no rotation is needed)

# Initialize outputs
SuccessMessage = ""
TargetPose0 = None
TargetPoseA = None
Program = ""
TCPOrientations = []
TargetPointCoordinates = []  # List to store target point coordinates

# Function to apply a Z-axis rotation to a Point3d
def rotate_point_around_z(point, angle_degrees):
    """Rotates a Rhino Point3d around the Z-axis by the given angle in degrees."""
    angle_radians = math.radians(angle_degrees)
    rotation_matrix = rg.Transform.Rotation(angle_radians, rg.Vector3d(0, 0, 1), rg.Point3d(0, 0, 0))
    rotated_point = rg.Point3d(point)
    rotated_point.Transform(rotation_matrix)
    return rotated_point

# Function to convert Rhino Plane to RoboDK Pose (4x4 matrix)
def plane_to_pose(plane):
    """Converts a Rhino plane to a RoboDK pose (4x4 matrix)."""
    pose = rdk.Mat([
        [plane.XAxis.X, plane.YAxis.X, plane.ZAxis.X, plane.OriginX],  
        [plane.XAxis.Y, plane.YAxis.Y, plane.ZAxis.Y, plane.OriginY],
        [plane.XAxis.Z, plane.YAxis.Z, plane.ZAxis.Z, plane.OriginZ],
        [0, 0, 0, 1]
    ])
    return pose

# Function to format the orientation of the TCP as strings for easy reporting
def format_tcp_orientation(plane, milestone):
    """Formats the TCP orientation (X, Y, Z axes) for a given milestone."""
    x_axis = plane.XAxis
    y_axis = plane.YAxis
    z_axis = plane.ZAxis
    return f"TCP orientation at {milestone}:\n  X-axis: {x_axis}\n  Y-axis: {y_axis}\n  Z-axis: {z_axis}"

# Function to format the target point coordinates {x, y, z} for reporting
def format_target_coordinates(plane, milestone):
    """Formats the target point coordinates as a string for a given milestone."""
    return f"{plane.Origin.X}, {plane.Origin.Y}, {plane.Origin.Z}"

# Check required inputs before proceeding
if not RobotName:
    SuccessMessage = "Error: RobotName is required."
elif not isinstance(TargetPoint0, rg.Point3d):
    SuccessMessage = "Error: TargetPoint0 must be a Rhino Point3d."
elif not isinstance(TargetPointA, rg.Point3d):
    SuccessMessage = "Error: TargetPointA must be a Rhino Point3d."
elif UpdateRoboDK is None:
    SuccessMessage = "Error: UpdateRoboDK toggle is required."
elif not UpdateRoboDK:
    SuccessMessage = "UpdateRoboDK is set to False. No action taken."
else:
    # Connect to RoboDK only if UpdateRoboDK is True
    RDK = rl.Robolink()  # Initialize RoboDK connection
    SuccessMessage = "Connected to RoboDK."
    
    # Retrieve the robot by name
    robot = RDK.Item(RobotName, rl.ITEM_TYPE_ROBOT)
    
    if not robot.Valid():
        SuccessMessage += f"\nError: Could not find {RobotName} in RoboDK."
    else:
        SuccessMessage += f"\nFound robot '{robot.Name()}' in RoboDK."
        
        # Get the robot's base and tool
        robot_base = robot.Parent()
        tool = robot.getLink(rl.ITEM_TYPE_TOOL)
        
        # Check if the robot base and tool are valid
        if not robot_base.Valid():
            SuccessMessage += "\nError: Robot's base not found."
        else:
            SuccessMessage += f"\nRobot base: {robot_base.Name()}"

        if not tool.Valid():
            SuccessMessage += "\nError: Robot's tool not found."
        else:
            SuccessMessage += f"\nRobot tool: {tool.Name()}"

        # Enable collision detection in RoboDK
        RDK.setCollisionActive(1)
        
        if not robot_base.Valid() or not tool.Valid():
            SuccessMessage += "\nCannot proceed without valid base and tool."
        else:
            # Apply the user-defined Z-axis rotation to the TargetPoint0 and TargetPointA
            # If BaseRotationZ is 0, no rotation will be applied
            if 'BaseRotationZ' in globals() and isinstance(BaseRotationZ, (int, float)):
                rotated_target_point_0 = rotate_point_around_z(TargetPoint0, BaseRotationZ)
                rotated_target_point_A = rotate_point_around_z(TargetPointA, BaseRotationZ)
            else:
                # No rotation needed, use the original points
                rotated_target_point_0 = TargetPoint0
                rotated_target_point_A = TargetPointA

            # Define the target points (TargetPoint0 and TargetPointA)
            # For TargetPoint0, the Z-axis should point downwards (towards [0, 0, -1])
            z_axis_0 = rg.Vector3d(0, 0, -1)  # TCP faces downwards at TargetPoint0
            x_axis_0 = rg.Vector3d(1, 0, 0)   # X-axis remains unchanged
            y_axis_0 = rg.Vector3d.CrossProduct(z_axis_0, x_axis_0)  # Recalculate Y-axis
            
            # For TargetPointA, the Z-axis should point forward (towards [1, 0, 0]) and Y-axis should point downwards
            z_axis_A = rg.Vector3d(1, 0, 0)   # TCP faces forward at TargetPointA
            y_axis_A = rg.Vector3d(0, 0, -1)  # Y-axis faces downwards at TargetPointA
            x_axis_A = rg.Vector3d.CrossProduct(y_axis_A, z_axis_A)  # Recalculate X-axis to ensure orthogonality

            # Create a plane for the rotated TargetPoint0 (with the TCP facing down)
            TargetPose0 = rg.Plane(rotated_target_point_0, x_axis_0, y_axis_0)
            # Convert TargetPose0 to RoboDK pose
            target_pose_robot_0 = plane_to_pose(TargetPose0)
            
            # Create a plane for the rotated TargetPointA (with the TCP facing forward and Y-axis down)
            TargetPoseA = rg.Plane(rotated_target_point_A, x_axis_A, y_axis_A)
            # Convert TargetPoseA to RoboDK pose
            target_pose_robot_A = plane_to_pose(TargetPoseA)

            # Parse target points and orientations for TargetPoint0 and TargetPointA
            TCPOrientations.append(format_tcp_orientation(TargetPose0, "TargetPoint0"))
            TCPOrientations.append(format_tcp_orientation(TargetPoseA, "TargetPointA"))
            TargetPointCoordinates.append(format_target_coordinates(TargetPose0, "TargetPoint0"))
            TargetPointCoordinates.append(format_target_coordinates(TargetPoseA, "TargetPointA"))

            # Add the movement targets in RoboDK
            target_0 = RDK.AddTarget("TargetPoint0", robot_base, robot)
            target_0.setAsCartesianTarget()
            target_0.setPose(target_pose_robot_0)
            
            target_A = RDK.AddTarget("TargetPointA", robot_base, robot)
            target_A.setAsCartesianTarget()
            target_A.setPose(target_pose_robot_A)

            SuccessMessage += "\nCreating program in RoboDK..."
            program_name = "MoveToTargetProgram"
            program = RDK.AddProgram(program_name, robot)
            
            program.setFrame(robot_base)  # Set the base frame of the robot
            program.setTool(tool)  # Set the tool of the robot

            # Add movements to the program: TargetPoint0 -> TargetPointA
            program.MoveJ(target_0)  # Move to TargetPoint0 (TCP facing downwards)
            program.MoveJ(target_A)  # Move to TargetPointA (TCP facing forward, Y-axis downwards)

            Program = program_name  # Assign the created program's name to the output
            SuccessMessage += f"\nProgram '{program_name}' created successfully."
# ---------- end python_3_script_7 ----------
custom_preview_2 = CustomPreview(Geometry=sphere, Material=ColourSwatch(SwatchColor=RGB(47, 237, 21)))
panel_16 = Panel(python_3_script_7.TCPOrientations)
panel_17 = Panel(python_3_script_7.TargetPointCoordinates)

# ----
# Real-Time Visualization
trigger = Trigger(Interval=10, TimerInterval=10, Target=[ur5_setup_2, ur5_setup_3, ur5_setup])  # disabled
group_toggle_6 = GroupToggle(ToggleActive=True, ToggleVisible=False)  # disabled
robot_1_3 = RemoteReceiver(robot_1)
robot_2_3 = RemoteReceiver(robot_2)

ur5_setup_2 = Python3Script(RobotName=robot_1_3)  # -> out, RobotPosition, X_Axis, Y_Axis, Z_Axis, JointPoints, JointLines, SuccessMessage
# ---------- ur5_setup_2: Python ----------
import robolink as rl  # RoboDK API
import robodk as rdk
import Rhino.Geometry as rg
import math
import numpy as np

# === Inputs ===
# RobotName: Name of the robot in RoboDK (e.g., "UR5")

# Initialize outputs
RobotPosition = None
X_Axis = None
Y_Axis = None
Z_Axis = None
JointPoints = []
JointLines = []
SuccessMessage = ""

# Initialize RoboDK connection
RDK = rl.Robolink()

# Get the robot by name
robot = RDK.Item(RobotName, rl.ITEM_TYPE_ROBOT)

if not robot.Valid():
    SuccessMessage = f"Error: Could not find {RobotName} in RoboDK."
else:
    SuccessMessage = f"Connected to {RobotName} in RoboDK."

    # Get the robot's base pose
    robot_base = robot.Parent()
    if robot_base.Valid():
        base_pose = robot_base.Pose()
    else:
        base_pose = rdk.Mat()

    # Get the robot's current joint angles (degrees)
    joints_deg = robot.Joints().list()
    # Convert joint angles to radians
    joints_rad = [math.radians(angle) for angle in joints_deg]

    # UR5 standard DH parameters (in millimeters)
    d1 = 89.159
    a2 = -425.00
    a3 = -392.25
    d4 = 109.15
    d5 = 94.65
    d6 = 82.3

    alpha = [math.pi/2, 0, 0, math.pi/2, -math.pi/2, 0]
    a = [0, a2, a3, 0, 0, 0]
    d = [d1, 0, 0, d4, d5, d6]
    theta = [
        joints_rad[0],
        joints_rad[1],
        joints_rad[2],
        joints_rad[3],
        joints_rad[4],
        joints_rad[5],
    ]

    # Initialize the base transformation matrix
    T_base = np.array(base_pose.rows)
    # Ensure T_base is a 4x4 matrix
    if T_base.shape != (4, 4):
        SuccessMessage += " Error: Base pose matrix is not 4x4."
    else:
        # Initialize the transformation matrix
        T = T_base

        # Initialize joint positions list
        JointPoints = []

        # Store transformation matrices for each joint
        T_matrices = []

        for i in range(6):  # Six joints
            # DH parameters for current joint
            ai = a[i]
            alphai = alpha[i]
            di = d[i]
            thetai = theta[i]

            # Compute transformation matrix using DH parameters
            cos_theta = math.cos(thetai)
            sin_theta = math.sin(thetai)
            cos_alpha = math.cos(alphai)
            sin_alpha = math.sin(alphai)

            T_joint = np.array([
                [cos_theta, -sin_theta * cos_alpha,  sin_theta * sin_alpha, ai * cos_theta],
                [sin_theta,  cos_theta * cos_alpha, -cos_theta * sin_alpha, ai * sin_theta],
                [0,          sin_alpha,              cos_alpha,             di],
                [0,          0,                      0,                     1]
            ])

            # Update the overall transformation matrix
            T = np.dot(T, T_joint)

            # Save the transformation matrix for this joint
            T_matrices.append(T.copy())

            # Extract the position of the current joint
            position = T[:3, 3]

            # No conversion needed since we're working in millimeters
            joint_point = rg.Point3d(position[0], position[1], position[2])
            JointPoints.append(joint_point)

        # Create lines connecting the joints
        JointLines = []
        for i in range(1, len(JointPoints)):
            line = rg.Line(JointPoints[i - 1], JointPoints[i])
            JointLines.append(line)

        # Optionally, connect the base to the first joint
        if JointPoints:
            base_position = T_base[:3, 3]
            base_point = rg.Point3d(base_position[0], base_position[1], base_position[2])
            line = rg.Line(base_point, JointPoints[0])
            JointLines.insert(0, line)

        # Fetch the robot's pose relative to its base
        robot_pose = robot.Pose()

        # Compute the absolute pose of the TCP in the world coordinate system
        absolute_pose = base_pose * robot_pose

        # Extract position from the absolute pose
        position = absolute_pose.Pos()  # [x, y, z]

        # Create Rhino point for the robot's TCP position
        RobotPosition = rg.Point3d(position[0], position[1], position[2])

        # Extract orientation vectors from the rotation matrix of the absolute pose
        x_vector = rg.Vector3d(absolute_pose[0,0], absolute_pose[1,0], absolute_pose[2,0])
        y_vector = rg.Vector3d(absolute_pose[0,1], absolute_pose[1,1], absolute_pose[2,1])
        z_vector = rg.Vector3d(absolute_pose[0,2], absolute_pose[1,2], absolute_pose[2,2])

        # Scale vectors for visualization purposes
        scale_factor = 200  # Adjust as needed
        x_vector *= scale_factor
        y_vector *= scale_factor
        z_vector *= scale_factor

        # Create lines representing the robot's TCP axes
        X_Axis = rg.Line(RobotPosition, x_vector)
        Y_Axis = rg.Line(RobotPosition, y_vector)
        Z_Axis = rg.Line(RobotPosition, z_vector)

        # Optionally, connect the last joint to the TCP
        if JointPoints and RobotPosition:
            line = rg.Line(JointPoints[-1], RobotPosition)
            JointLines.append(line)
# ---------- end ur5_setup_2 ----------
ur5_setup_3 = Python3Script(RobotName=robot_2_3)  # -> out, RobotPosition, X_Axis, Y_Axis, Z_Axis, JointPoints, JointLines, SuccessMessage; same code as ur5_setup_2

panel_18 = Panel(ur5_setup_2.JointLines)
panel_19 = Panel(ur5_setup_2.RobotPosition)
panel_20 = Panel(ur5_setup_2.X_Axis)
panel_21 = Panel(ur5_setup_2.Y_Axis)
panel_22 = Panel(ur5_setup_2.Z_Axis)
panel_23 = Panel(ur5_setup_2.SuccessMessage)
panel_24 = Panel(ur5_setup_3.JointLines)
panel_25 = Panel(ur5_setup_3.RobotPosition)
panel_26 = Panel(ur5_setup_3.X_Axis)
panel_27 = Panel(ur5_setup_3.Y_Axis)
panel_28 = Panel(ur5_setup_3.Z_Axis)
panel_29 = Panel(ur5_setup_3.SuccessMessage)
panel_30 = Panel(ur5_setup_2.JointPoints)
panel_31 = Panel(ur5_setup_3.JointPoints)

list_item_8 = ListItem(List=[ur5_setup_2.X_Axis, ur5_setup_3.X_Axis], Index=0, Wrap=True)  # -> Item, Item1
list_item_9 = ListItem(List=[ur5_setup_2.Y_Axis, ur5_setup_3.Y_Axis], Index=0, Wrap=True)  # -> Item, Item1
list_item_10 = ListItem(List=[ur5_setup_2.Z_Axis, ur5_setup_3.Z_Axis], Index=0, Wrap=True)  # -> Item, Item1

colour_swatch = ColourSwatch(SwatchColor=RGB(255, 0, 0))
colour_swatch_2 = ColourSwatch(SwatchColor=RGB(82, 255, 3))
colour_swatch_3 = ColourSwatch(SwatchColor=RGB(17, 101, 145))
entwine = Entwine(
    Branch00=list_item_8.Item,
    Branch01=list_item_9.Item,
    Branch02=list_item_10.Item,
    Branch03=list_item_8.Item1,
    Branch04=list_item_9.Item1,
    Branch05=list_item_10.Item1,
    Branch06=ur5_setup.X_Axis,
    Branch07=ur5_setup.Y_Axis,
    Branch08=ur5_setup.Z_Axis,
    FlattenInputs=True)
entwine_2 = Entwine(
    Branch00=colour_swatch,
    Branch01=colour_swatch_2,
    Branch02=colour_swatch_3,
    Branch03=colour_swatch,
    Branch04=colour_swatch_2,
    Branch05=colour_swatch_3,
    Branch06=colour_swatch,
    Branch07=colour_swatch_2,
    Branch08=colour_swatch_3,
    FlattenInputs=True)
custom_preview_lineweights_2 = CustomPreviewLineweights(Geometry=entwine, Shader=entwine_2, Thickness=Slider(3, range=0..10), Absolute=False)

entwine_3 = Entwine(Branch00=ur5_setup_2.JointPoints, Branch01=ur5_setup_3.JointPoints, FlattenInputs=True)
sphere_2 = Sphere(Base=entwine_3, Radius=Slider(20.8, range=0..100))
custom_preview_3 = CustomPreview(Geometry=sphere_2, Material=ColourSwatch(SwatchColor=RGB(21, 201, 237)))
panel_32 = Panel("""J0
J1
J2
J3
J4
J5""")
panel_33 = Panel("""J0
J1
J2
J3
J4
J5""")
colour_swatch_4 = ColourSwatch(SwatchColor=RGB(255, 0, 0))

group_toggle_7 = GroupToggle(ToggleActive=True, ToggleVisible=False)  # disabled
entwine_4 = Entwine(Branch00=list_item_9.Item, Branch01=list_item_9.Item1, Branch02=ur5_setup.Y_Axis, FlattenInputs=True)
entwine_5 = Entwine(Branch00=list_item_10.Item, Branch01=list_item_10.Item1, Branch02=ur5_setup.Z_Axis, FlattenInputs=True)
merge = Merge(Data1=ur5_setup_2.JointLines, Data2=ur5_setup_3.JointLines, Data3=ur5_setup.JointLines)
data_3 = Data(sphere_2)

entwine_6 = Entwine(Branch00=list_item_8.Item, Branch01=list_item_8.Item1, Branch02=ur5_setup.X_Axis, FlattenInputs=True)
end_points = EndPoints(Curve=entwine_6)  # -> Start, End
end_points_2 = EndPoints(Curve=entwine_4)  # -> Start, End
end_points_3 = EndPoints(Curve=entwine_5)  # -> Start, End
text_tag = TextTag(Location=end_points.End, Text="x")
text_tag_2 = TextTag(Location=end_points_2.End, Text="y")
text_tag_3 = TextTag(Location=end_points_3.End, Text="z")

custom_preview_lineweights_3 = CustomPreviewLineweights(Geometry=merge, Shader=ColourSwatch(SwatchColor=RGB(26, 26, 26)), Thickness=Slider(2, range=0..200), Absolute=False)

panel_34 = Panel(data_3)
area_5 = Area(Geometry=data_3)  # -> Area, Centroid
scale_3 = Scale(Geometry=sphere_2, Center=area_5.Centroid, Factor=Slider(1.73, range=0..3))  # -> Geometry, Transform
tree_branch = TreeBranch(Tree=area_5.Centroid, Path="{0;1}", MaintainPaths=True)  # -> flatten(Branch)
text_tag_4 = TextTag(Location=tree_branch, Text=panel_33, Colour=colour_swatch_4)

tree_branch_2 = TreeBranch(Tree=area_5.Centroid, Path="{0;0}", MaintainPaths=True)  # -> flatten(Branch)
panel_35 = Panel(tree_branch_2)

text_tag_5 = TextTag(Location=tree_branch_2, Text=panel_32, Colour=colour_swatch_4)

divide_curve = DivideCurve(Curve=data_2, Count=10, Kinks=False)  # -> Points, Tangents, Parameters
point_8 = Point(divide_curve.Points)
list_item_11 = ListItem(List=tablepoints_4, Index=data_dam, Wrap=True)
point_9 = Point(list_item_11)
number_slider_12 = Slider(54, range=0..142)
list_item_12 = ListItem(List=tablepoints_4, Index="211", Wrap=True)

# ----
# orientation frames
# midpoints
# lines
point_10 = Point(data)
line_2 = Line(data_2)
end_points_4 = EndPoints(Curve=line_2)  # -> graft(Start), graft(End)
negative_2 = Negative(Value="10000")
trim_tree = TrimTree(Tree=end_points_4.Start, Depth=1)
stream_filter_5 = StreamFilter(Gate=value_list_4, Stream0="10000", Stream1=negative_2)
unit_z_5 = UnitZ(Factor=stream_filter_5)
move_2 = Move(Geometry=point_9, Motion=unit_z_5)  # -> Geometry, Transform
plane_3pt = Plane3Pt(PointA=point_10, PointB=trim_tree, PointC=move_2.Geometry)  # -> flatten(Plane)
rotate_plane_by_axis = RotatePlaneByAxis(Plane=plane_3pt, Axis="x", Angle=90)
plane = Plane(rotate_plane_by_axis)
deconstruct_plane = DeconstructPlane(Plane=plane)  # -> Origin, XAxis, YAxis, ZAxis
amplitude = Amplitude(Vector=deconstruct_plane.ZAxis, Amplitude=50)
vector_display = VectorDisplay(Anchor=deconstruct_plane.Origin, Vector=amplitude)

# ----
# Collision Points
entwine_7 = Entwine(Branch00=point_8, Branch01=populate_2d_2, Branch02=populate_2d, FlattenInputs=True)
point_11 = Point(entwine_7)
panel_36 = Panel(entwine_7)

# ----
# approach plane
number_slider_13 = Slider(50, range=0..100)
deconstruct_plane_2 = DeconstructPlane(Plane=plane)  # -> Origin, XAxis, YAxis, ZAxis
amplitude_2 = Amplitude(Vector=deconstruct_plane_2.ZAxis, Amplitude=expr("-x", number_slider_13))
move_3 = Move(Geometry=plane, Motion=amplitude_2)  # -> Geometry, Transform

# ----
# stack
xy_plane = XYPlane(Origin=list_item_12)
flip_plane = FlipPlane(Plane=xy_plane, ReverseX=False, ReverseY=False, SwapAxes=True)
list_length_2 = ListLength(List=plane)
duplicate_data_2 = DuplicateData(Data=flip_plane, Number=expr("x-1", list_length_2), Order=True)  # -> flatten(Data)

# ----
# inbetween plane
number_slider_14 = Slider(400, range=0..1000)
sphere_3 = Sphere(Base=point_9, Radius=number_slider_14)
tween_two_planes = TweenTwoPlanes(PlaneA=plane, PlaneB=flip_plane, Factor=0.5, Quaternion=Toggle(True))
volume = Volume(Geometry=sphere_3)  # -> Volume, Centroid
distance = Distance(PointA=tween_two_planes, PointB=volume.Centroid)
surface_closest_point = SurfaceClosestPoint(Point=tween_two_planes, Surface=sphere_3)  # -> Point, UVPoint, Distance
number_slider_15 = Slider(0, range=0..30)
smaller_than = SmallerThan(FirstNumber=distance, SecondNumber=number_slider_14)  # -> SmallerThan, OrEqualTo
plane_origin = PlaneOrigin(Base=tween_two_planes, Origin=surface_closest_point.Point)
list_item_13 = ListItem(List=plane_origin, Index=number_slider_15, Wrap=True)
list_item_14 = ListItem(List=plane, Index=number_slider_15, Wrap=True)
list_item_15 = ListItem(List=flip_plane, Index=number_slider_15, Wrap=True)
custom_preview_4 = CustomPreview(
    Geometry=[list_item_13, list_item_14, list_item_15],
    Material={diffuse=RGB(221, 160, 221), emission=RGB(66, 48, 66), shine=0.5, specular=RGB(255, 255, 255), transparency=0})

panel_37 = Panel("""0
1
2
3""")
weave = Weave(
    Pattern=panel_37,
    Stream0=duplicate_data_2,
    Stream1=move_3.Geometry,
    Stream2=plane,
    Stream3=move_3.Geometry,
    NullGaps=False)  # -> flatten(Weave)
panel_38 = Panel(weave)
split_list_3 = SplitList(List=weave, Index="10")  # -> ListA, ListB
planes = RemoteSender(split_list_3.ListA)

# ----
# Version 3
value_list_5 = ValueList({"UR5": 0, "COMAU": 1, "Coworking Mode": 2}, selected="COMAU")
panel_39 = Panel("""UR5
COMAU""")
stream_filter_6 = StreamFilter(Gate=value_list_5, Stream0="UR5", Stream1="COMAU", Stream2=panel_39)
group_toggle_8 = GroupToggle(ToggleActive=True, ToggleVisible=False)  # disabled
planes_2 = RemoteReceiver(planes)
python_3_script_8 = Python3Script(RobotNames=stream_filter_6, UpdateRoboDK=Toggle(False), PlanesList=planes_2)  # -> out, SuccessMessage, TCPOrientations, TargetPointCoordinates; inputs RobotNames: list, PlanesList: list of Plane
# ---------- python_3_script_8: Python ----------
import robolink as rl    # RoboDK API for controlling and communicating with RoboDK
import robodk as rdk     # RoboDK tools, such as matrix operations and other utilities
import Rhino.Geometry as rg
import math

# === Inputs ===
# RobotNames: List of robot names (e.g., ["UR5_1", "UR5_2"])
# UpdateRoboDK: Boolean toggle to execute the script and update RoboDK when True
# PlanesList: List of Rhino Plane objects (each plane contains both target point and orientation)

# Initialize outputs
SuccessMessage = ""
TargetPoses = []  # List of converted poses for both robots
Program = ""
TCPOrientations = []
TargetPointCoordinates = []

# Function to convert Rhino Plane to RoboDK Pose (4x4 matrix)
def plane_to_pose(plane):
    """Converts a Rhino plane to a RoboDK pose (4x4 matrix)."""
    pose = rdk.Mat([
        [plane.XAxis.X, plane.YAxis.X, plane.ZAxis.X, plane.OriginX],
        [plane.XAxis.Y, plane.YAxis.Y, plane.ZAxis.Y, plane.OriginY],
        [plane.XAxis.Z, plane.YAxis.Z, plane.ZAxis.Z, plane.OriginZ],
        [0, 0, 0, 1]
    ])
    return pose

# Function to format the orientation of the TCP as strings for easy reporting
def format_tcp_orientation(plane, milestone):
    """Formats the TCP orientation (X, Y, Z axes) for a given milestone."""
    x_axis = plane.XAxis
    y_axis = plane.YAxis
    z_axis = plane.ZAxis
    return f"TCP orientation at {milestone}:\n  X-axis: {x_axis}\n  Y-axis: {y_axis}\n  Z-axis: {z_axis}"

# Function to format the target point coordinates {x, y, z} for reporting
def format_target_coordinates(plane, milestone):
    """Formats the target point coordinates as a string for a given milestone."""
    return f"{plane.OriginX}, {plane.OriginY}, {plane.OriginZ}"

# Check required inputs before proceeding
if not RobotNames or not isinstance(RobotNames, list):
    SuccessMessage = "Error: RobotNames must be a list of robot names."
elif len(RobotNames) != 2:
    SuccessMessage = "Error: Please provide exactly 2 robot names."
elif not PlanesList or not isinstance(PlanesList, list):
    SuccessMessage = "Error: PlanesList must be a list of Rhino Plane objects."
elif any(not isinstance(plane, rg.Plane) for plane in PlanesList):
    SuccessMessage = "Error: All elements in PlanesList must be Rhino Plane objects."
elif UpdateRoboDK is None:
    SuccessMessage = "Error: UpdateRoboDK toggle is required."
elif not UpdateRoboDK:
    SuccessMessage = "UpdateRoboDK is set to False. No action taken."
else:
    # Connect to RoboDK only if UpdateRoboDK is True
    RDK = rl.Robolink()  # Initialize RoboDK connection
    SuccessMessage = "Connected to RoboDK."
    
    # Retrieve both robots by name
    robot1 = RDK.Item(RobotNames[0], rl.ITEM_TYPE_ROBOT)
    robot2 = RDK.Item(RobotNames[1], rl.ITEM_TYPE_ROBOT)
    
    if not robot1.Valid() or not robot2.Valid():
        SuccessMessage += "\nError: Could not find both robots in RoboDK."
    else:
        SuccessMessage += f"\nFound robots '{robot1.Name()}' and '{robot2.Name()}' in RoboDK."
        
        # Split PlanesList into two roughly equal parts
        midpoint = len(PlanesList) // 2
        planes_robot1 = PlanesList[:midpoint]
        planes_robot2 = PlanesList[midpoint:]

        # Get the robot base and tool for both robots
        robot_base1 = robot1.Parent()
        tool1 = robot1.getLink(rl.ITEM_TYPE_TOOL)
        robot_base2 = robot2.Parent()
        tool2 = robot2.getLink(rl.ITEM_TYPE_TOOL)

        # Check if the robot base and tool are valid
        if not robot_base1.Valid() or not robot_base2.Valid():
            SuccessMessage += "\nError: One or both robot bases not found."
        elif not tool1.Valid() or not tool2.Valid():
            SuccessMessage += "\nError: One or both robot tools not found."
        else:
            SuccessMessage += f"\nRobot bases: {robot_base1.Name()} and {robot_base2.Name()}"
            SuccessMessage += f"\nRobot tools: {tool1.Name()} and {tool2.Name()}"

            # Enable collision detection in RoboDK
            RDK.setCollisionActive(1)

            # Set both robots to home positions before starting
            robot1.MoveJ(robot1.JointsHome())
            robot2.MoveJ(robot2.JointsHome())

            # Create a new program for both robots
            SuccessMessage += "\nCreating program in RoboDK..."
            program_name = "MoveThroughPlanesProgram_BothRobots"
            program = RDK.AddProgram(program_name)

            # Loop through planes for both robots
            for idx, (plane1, plane2) in enumerate(zip(planes_robot1, planes_robot2)):
                # Convert plane to RoboDK pose for robot 1
                target_pose_robot1 = plane_to_pose(plane1)
                base_pose_inv1 = robot_base1.Pose().inv()
                target_pose_relative1 = base_pose_inv1 * target_pose_robot1

                # Convert plane to RoboDK pose for robot 2
                target_pose_robot2 = plane_to_pose(plane2)
                base_pose_inv2 = robot_base2.Pose().inv()
                target_pose_relative2 = base_pose_inv2 * target_pose_robot2

                # Store the poses
                TargetPoses.append((target_pose_relative1, target_pose_relative2))

                # Add the movement targets for both robots
                target_name1 = f"Robot1_Plane_{idx+1}"
                target1 = RDK.AddTarget(target_name1, robot_base1, robot1)
                target1.setAsCartesianTarget()
                target1.setPose(target_pose_relative1)

                target_name2 = f"Robot2_Plane_{idx+1}"
                target2 = RDK.AddTarget(target_name2, robot_base2, robot2)
                target2.setAsCartesianTarget()
                target2.setPose(target_pose_relative2)

                # Add the movement commands for both robots to the same program
                program.MoveJ(target1)
                program.MoveJ(target2)

            # Assign the created program name to the output
            Program = program_name
            SuccessMessage += f"\nProgram '{program_name}' created successfully."
# ---------- end python_3_script_8 ----------
panel_40 = Panel(python_3_script_8.SuccessMessage)

robot_1_4 = RemoteReceiver(robot_1)
planes_3 = RemoteReceiver(planes)
python_3_script_9 = Python3Script(RobotName=robot_1_4, UpdateRoboDK=Toggle(False), PlanesList=planes_3)  # -> out, SuccessMessage, TargetPoses, Program, TCPOrientations; inputs PlanesList: list of Plane
# ---------- python_3_script_9: Python ----------
import robolink as rl    # RoboDK API for controlling and communicating with RoboDK 
import robodk as rdk     # RoboDK tools, such as matrix operations and other utilities
import Rhino.Geometry as rg
import math

# === Inputs ===
# RobotName: Name of the robot in RoboDK (e.g., "UR5")
# UpdateRoboDK: Boolean toggle to execute the script and update RoboDK when True
# PlanesList: List of Rhino Plane objects (each plane contains both target point and orientation)

# Initialize outputs
SuccessMessage = ""
TargetPoses = []  # List of converted poses
Program = ""
TCPOrientations = []
TargetPointCoordinates = []

# Function to convert Rhino Plane to RoboDK Pose (4x4 matrix)
def plane_to_pose(plane):
    """Converts a Rhino plane to a RoboDK pose (4x4 matrix)."""
    pose = rdk.Mat([
        [plane.XAxis.X, plane.YAxis.X, plane.ZAxis.X, plane.OriginX],
        [plane.XAxis.Y, plane.YAxis.Y, plane.ZAxis.Y, plane.OriginY],
        [plane.XAxis.Z, plane.YAxis.Z, plane.ZAxis.Z, plane.OriginZ],
        [0, 0, 0, 1]
    ])
    return pose

# Function to format the orientation of the TCP as strings for easy reporting
def format_tcp_orientation(plane, milestone):
    """Formats the TCP orientation (X, Y, Z axes) for a given milestone."""
    x_axis = plane.XAxis
    y_axis = plane.YAxis
    z_axis = plane.ZAxis
    return f"TCP orientation at {milestone}:\n  X-axis: {x_axis}\n  Y-axis: {y_axis}\n  Z-axis: {z_axis}"

# Function to format the target point coordinates {x, y, z} for reporting
def format_target_coordinates(plane, milestone):
    """Formats the target point coordinates as a string for a given milestone."""
    return f"{plane.OriginX}, {plane.OriginY}, {plane.OriginZ}"

# Check required inputs before proceeding
if not RobotName:
    SuccessMessage = "Error: RobotName is required."
elif not PlanesList or not isinstance(PlanesList, list):
    SuccessMessage = "Error: PlanesList must be a list of Rhino Plane objects."
elif any(not isinstance(plane, rg.Plane) for plane in PlanesList):
    SuccessMessage = "Error: All elements in PlanesList must be Rhino Plane objects."
elif UpdateRoboDK is None:
    SuccessMessage = "Error: UpdateRoboDK toggle is required."
elif not UpdateRoboDK:
    SuccessMessage = "UpdateRoboDK is set to False. No action taken."
else:
    # Connect to RoboDK only if UpdateRoboDK is True
    RDK = rl.Robolink()  # Initialize RoboDK connection
    SuccessMessage = "Connected to RoboDK."
    
    # Retrieve the robot by name
    robot = RDK.Item(RobotName, rl.ITEM_TYPE_ROBOT)
    
    if not robot.Valid():
        SuccessMessage += f"\nError: Could not find {RobotName} in RoboDK."
    else:
        SuccessMessage += f"\nFound robot '{robot.Name()}' in RoboDK."
        
        # Get the robot's base and tool
        robot_base = robot.Parent()
        tool = robot.getLink(rl.ITEM_TYPE_TOOL)
        
        # Check if the robot base and tool are valid
        if not robot_base.Valid():
            SuccessMessage += "\nError: Robot's base not found."
        else:
            SuccessMessage += f"\nRobot base: {robot_base.Name()}"

        if not tool.Valid():
            SuccessMessage += "\nError: Robot's tool not found."
        else:
            SuccessMessage += f"\nRobot tool: {tool.Name()}"

        # Enable collision detection in RoboDK
        RDK.setCollisionActive(1)

        if not robot_base.Valid() or not tool.Valid():
            SuccessMessage += "\nCannot proceed without valid base and tool."
        else:
            # Set the robot to its home position before starting
            robot.MoveJ(robot.JointsHome())

            # Get the robot base frame pose
            base_pose = robot_base.Pose()

            # Create a new program
            SuccessMessage += "\nCreating program in RoboDK..."
            program_name = "MoveThroughPlanesProgram"
            program = RDK.AddProgram(program_name, robot)
            program.setFrame(robot_base)  # Set the base frame of the robot
            program.setTool(tool)  # Set the tool of the robot

            # Process each plane in PlanesList independently
            for idx, plane in enumerate(PlanesList):
                # Convert plane to RoboDK pose
                target_pose_robot = plane_to_pose(plane)

                # Adjust the target pose with respect to the robot's base frame
                base_pose_inv = base_pose.inv()
                target_pose_relative = base_pose_inv * target_pose_robot

                # Store the pose
                TargetPoses.append(target_pose_relative)

                # Format TCP orientation and coordinates for reporting
                milestone = f"Plane {idx+1}"
                TCPOrientations.append(format_tcp_orientation(plane, milestone))
                TargetPointCoordinates.append(format_target_coordinates(plane, milestone))

                # Add the movement target in RoboDK
                target_name = f"Plane_{idx+1}"
                target = RDK.AddTarget(target_name, robot_base, robot)
                target.setAsCartesianTarget()
                target.setPose(target_pose_relative)

                # Add movements to the program independently
                program.MoveJ(target)  # Move to the target

            Program = program_name  # Assign the created program's name to the output
            SuccessMessage += f"\nProgram '{program_name}' created successfully."
# ---------- end python_3_script_9 ----------
panel_41 = Panel(python_3_script_9.TargetPoses)
panel_42 = Panel(python_3_script_9.TCPOrientations)
panel_43 = Panel(python_3_script_9.SuccessMessage)
panel_44 = Panel(python_3_script_9.Program)

planes_4 = RemoteReceiver(planes)
python_3_script_10 = Python3Script(RobotName=robot_3_3, UpdateRoboDK=Toggle(False), PlanesList=planes_4)  # -> out, SuccessMessage, TargetPoses, Program, TCPOrientations, a; inputs PlanesList: list of Plane; same code as python_3_script_9
panel_45 = Panel(python_3_script_10.TargetPoses)
panel_46 = Panel(python_3_script_10.Program)
panel_47 = Panel(python_3_script_10.TCPOrientations)
panel_48 = Panel(python_3_script_10.SuccessMessage)
panel_49 = Panel(python_3_script_10.a)

list_item_16 = ListItem(List=planes, Index=Slider(7, range=0..100), Wrap=True)
plane_2 = Plane(list_item_16)
