# Grasshopper definition 211024_RoboticAssembly_Prototype.gh (Grasshopper 1.0.8)
# plug-ins: RhinoCodePluginGH, Pufferfish, Human, Palette, Telepathy

palette = Palette(
    ModeCustomStandard=Toggle(True),
    Component_Normal_Deselected_Fill_Color=RGB(200, 200, 200),
    Component_Normal_Deselected_Edge_Color=RGB(50, 50, 50),
    Component_Normal_Deselected_Text_Color=RGB(0, 0, 0),
    Component_Normal_Selected_Fill_Color=RGB(130, 215, 50),
    Component_Normal_Selected_Edge_Color=RGB(0, 50, 0),
    Component_Normal_Selected_Text_Color=RGB(0, 25, 0),
    Component_Hidden_Deselected_Fill_Color=RGB(140, 140, 155),
    Component_Hidden_Deselected_Edge_Color=RGB(35, 35, 35),
    Component_Hidden_Deselected_Text_Color=RGB(0, 0, 0),
    Component_Hidden_Selected_Fill_Color=RGB(80, 180, 10),
    Component_Hidden_Selected_Edge_Color=RGB(0, 35, 0),
    Component_Hidden_Selected_Text_Color=RGB(0, 25, 0),
    Component_Disabled_Deselected_Fill_Color=RGB(120, 120, 120),
    Component_Disabled_Deselected_Edge_Color=RGB(90, 90, 90),
    Component_Disabled_Deselected_Text_Color=RGB(70, 70, 70),
    Component_Disabled_Selected_Fill_Color=RGB(110, 150, 115),
    Component_Disabled_Selected_Edge_Color=RGB(40, 70, 40),
    Component_Disabled_Selected_Text_Color=RGB(75, 100, 65),
    Component_Warning_Deselected_Fill_Color=RGB(255, 140, 20),
    Component_Warning_Deselected_Edge_Color=RGB(80, 10, 0),
    Component_Warning_Deselected_Text_Color=RGB(0, 0, 0),
    Component_Warning_Selected_Fill_Color=RGB(185, 205, 0),
    Component_Warning_Selected_Edge_Color=RGB(0, 50, 0),
    Component_Warning_Selected_Text_Color=RGB(0, 0, 0),
    Component_Error_Deselected_Fill_Color=RGB(200, 0, 0),
    Component_Error_Deselected_Edge_Color=RGB(60, 0, 0),
    Component_Error_Deselected_Text_Color=RGB(0, 0, 0),
    Component_Error_Selected_Fill_Color=RGB(125, 155, 0),
    Component_Error_Selected_Edge_Color=RGB(0, 50, 0),
    Component_Error_Selected_Text_Color=RGB(255, 255, 255),
    Component_Label_Deselected_Fill_Color=RGB(50, 50, 50),
    Component_Label_Deselected_Edge_Color=RGB(0, 0, 0),
    Component_Label_Deselected_Text_Color=RGB(255, 255, 255),
    Component_Label_Selected_Fill_Color=RGB(25, 60, 25),
    Component_Label_Selected_Edge_Color=RGB(0, 35, 0),
    Component_Label_Selected_Text_Color=RGB(190, 250, 180),
    Galapagos_Deselected_Fill_Color=RGB(255, 0, 125),
    Galapagos_Deselected_Edge_Color=RGB(100, 0, 50),
    Galapagos_Selected_Fill_Color=RGB(160, 210, 30),
    Galapagos_Selected_Edge_Color=RGB(0, 50, 0),
    Wire_Normal_Color=RGBA(0, 0, 0, 150),
    Wire_Empty_Color=RGBA(255, 60, 0, 180),
    Wire_Selected_Start_Color=RGB(125, 210, 40),
    Wire_Selected_End_Color=RGBA(0, 0, 0, 50),
    Panel_Default_Color=RGB(255, 250, 90),
    Group_Default_Color=RGBA(255, 255, 255, 150),
    Canvas_Background_Color=RGB(84, 84, 84),
    Canvas_Gridline_Color=RGBA(0, 0, 0, 30),
    Canvas_Gridline_Width=150,
    Canvas_Gridline_Height=50,
    Canvas_Edge_Color=RGB(255, 255, 255),
    Canvas_Shadow_Color=RGBA(0, 0, 0, 80),
    Canvas_Shadow_Size=30,
    MonochromaticOnOff=False,
    Monochromatic_Color=RGB(212, 208, 200))

# ----
# Physical Calibration
number_slider = Slider(20, range=0..100)
tablepoints = Point([<point referenced from the Rhino model> x1683])
point = Point([<point referenced from the Rhino model> x1683])
tablepointscomau = RemoteSender(point)
unit_z = UnitZ(Factor="20")
tablepointsur5 = RemoteSender(tablepoints)
move = Move(Geometry=tablepointscomau, Motion=unit_z)  # -> Geometry, Transform
unit_z_2 = UnitZ(Factor=number_slider)
move_2 = Move(Geometry=tablepointsur5, Motion=unit_z_2)  # -> Geometry, Transform
point_list = PointList(Points=move_2.Geometry, Size=Slider(10, range=1..10))
point_list_2 = PointList(Points=move.Geometry, Size=Slider(10, range=1..10))
tablepointscomau_2 = RemoteReceiver(tablepointscomau)
tablepointsur5_2 = RemoteReceiver(tablepointsur5)
deconstruct = Deconstruct(Point=tablepointscomau_2)  # -> XComponent, YComponent, ZComponent
deconstruct_2 = Deconstruct(Point=tablepointsur5_2)  # -> XComponent, YComponent, ZComponent
concatenate = Concatenate(
    FragmentA="{",
    FragmentB=deconstruct_2.XComponent,
    FragmentA_2=",",
    FragmentB_2=deconstruct_2.YComponent,
    FragmentA_3=",",
    FragmentA_4=deconstruct_2.ZComponent,
    FragmentA_5="}")  # -> flatten(Result)
concatenate_2 = Concatenate(
    FragmentA="{",
    FragmentB=deconstruct.XComponent,
    FragmentA_2=",",
    FragmentB_2=deconstruct.YComponent,
    FragmentA_3=",",
    FragmentA_4=deconstruct.ZComponent,
    FragmentA_5="}")  # -> flatten(Result)

value_list = ValueList({"UR5 A": 0, "UR5 B": 1, "COMAU": 2, "COWORKING": 3}, selected="UR5 A")
value_list_2 = ValueList({"UR5 A": 0, "UR5 B": 1, "COMAU": 2, "COWORKING": 3}, selected="UR5 B")
panel = Panel("""UR5 A
COMAU""")
stream_filter = StreamFilter(Gate=value_list, Stream0="UR5 A", Stream1="UR5 B", Stream2="COMAU", Stream3=panel)
stream_filter_2 = StreamFilter(Gate=value_list_2, Stream0="UR5 A", Stream1="UR5 B", Stream2="COMAU", Stream3=panel)
robot_1 = RemoteSender(stream_filter)
robot_2 = RemoteSender(stream_filter_2)

# ----
# Robot Setup & Base Sync
value_list_3 = ValueList({"UR5 A": 0, "UR5 B": 1, "COMAU": 2, "COWORKING": 3}, selected="COMAU")
stream_filter_3 = StreamFilter(Gate=value_list_3, Stream0="UR5 A", Stream1="UR5 B", Stream2="COMAU", Stream3=panel)
robot_3 = RemoteSender(stream_filter_3)

# ----
# Prototype Base
number_slider_2 = Slider(-200, range=-600..600)
unit_z_3 = UnitZ(Factor=number_slider_2)
curve = Curve(<curve referenced from the Rhino model>)
extrude = Extrude(Base=curve, Direction=unit_z_3)
offset_surface = OffsetSurface(Surface=extrude, Distance=Slider(20, range=0..200), BothSides=Toggle(False), CreateSolid=Toggle(True))
custom_preview = CustomPreview(Geometry=offset_surface, Material=ColourSwatch(SwatchColor=RGB(255, 255, 255)))
deconstruct_brep = DeconstructBrep(Brep=offset_surface)  # -> flatten(Faces), Edges, Vertices
populate_2d = Populate2D(Region=deconstruct_brep.Faces, Count=Slider(40, range=0..100), Seed=1)  # -> flatten(Population)
point_2 = Point(populate_2d)  # disabled

data_dam = DataDam(DataDataA=Slider(1654, range=0..1683), BufferDelay=10000000, BufferMode=0)
data_dam_2 = DataDam(DataDataA=Slider(180, range=-360..360), BufferDelay=10000000, BufferMode=0)
data_dam_3 = DataDam(DataDataA=Slider(549, range=0..1683), BufferDelay=10000000, BufferMode=0)
data_dam_4 = DataDam(DataDataA=Slider(90, range=-360..360), BufferDelay=10000000, BufferMode=0)
data_dam_5 = DataDam(DataDataA=Slider(392, range=0..1683), BufferDelay=10000000, BufferMode=0)
data_dam_6 = DataDam(DataDataA=Slider(180, range=-360..360), BufferDelay=10000000, BufferMode=0)
robot_1_2 = RemoteReceiver(robot_1)
robot_2_2 = RemoteReceiver(robot_2)
robot_3_2 = RemoteReceiver(robot_3)
python_3_script = Python3Script(TablePoints=concatenate, RobotName=robot_1_2, PointIndex=data_dam, SetBase=Toggle(False), RotationZ=data_dam_2)  # -> out, BasePosition, SuccessMessage; inputs TablePoints: list of Point3d, PointIndex: Int32, RotationZ: Double
# ---------- python_3_script: Python ----------
import robolink as rl        # RoboDK API for communication 
import robodk as rdk         # RoboDK robotic simulation environment
import Rhino.Geometry as rg  # Rhino geometry for working with 3D points
import math                  # Math module for calculations

# Initialize RoboDK link
RDK = rl.Robolink()
# Ensure that RobotName is defined correctly from Grasshopper
if 'RobotName' not in globals() or not RobotName:
    raise NameError("RobotName is not defined or empty.")

# Fetch robot item by name
robot = RDK.Item(RobotName, rl.ITEM_TYPE_ROBOT)

# Ensure the robot is found in RoboDK
if not robot.Valid():
    raise NameError(f"Error: Could not find robot '{RobotName}' in RoboDK.")

# Define functions
def connect_to_robot(robot_name) -> str:
    """
    Connect to the robot using its name and return a success or error message.

    :param robot_name: The name of the robot in RoboDK.
    :return: A message indicating success or error.
    """
    robot = RDK.Item(robot_name, rl.ITEM_TYPE_ROBOT)
    if not robot.Valid():
        return f"Error: Could not find robot '{robot_name}' in RoboDK."
    else:
        return f"Connected to robot '{robot_name}' in RoboDK."


def set_robot_base(robot, x, y, z, rz_deg) -> str:
    """
    Set the robot's base at a specific point (x, y, z) with a rotation along the Z-axis.

    :param robot: The robot item in RoboDK.
    :param x: X coordinate for the base position.
    :param y: Y coordinate for the base position.
    :param z: Z coordinate for the base position.
    :param rz_deg: Rotation angle around the Z-axis in degrees.
    :return: A success or error message regarding the base setting.
    """
    rz_rad = math.radians(rz_deg)  # Convert degrees to radians
    rotation_matrix = rdk.rotz(rz_rad)  # Create a rotation matrix
    translation_matrix = rdk.transl(x, y, z)  # Create a translation matrix
    base_pose = translation_matrix * rotation_matrix  # Combine translation and rotation

    robot_base = robot.Parent()  # Get the robot's base (parent in RoboDK)

    if robot_base.Valid():
        robot_base.setPose(base_pose)  # Set the base pose
        return f"Robot '{RobotName}' base set at Point {PointIndex} with RotationZ={rz_deg} degrees successfully."
    else:
        return "Error: Could not find or access the robot base."


def get_current_base_position(robot) -> str:
    """
    Retrieve the current base position and rotation of the robot.

    :param robot: The robot item in RoboDK.
    :return: A string containing the current base position and rotation details.
    """
    robot_base = robot.Parent()  # Get the robot's base

    if robot_base.Valid():
        current_base_pose = robot_base.Pose()  # Get the current pose of the base
        current_position = current_base_pose.Pos()  # Extract position (X, Y, Z)
        rx_rad, ry_rad, rz_rad = rdk.pose_2_xyzrpy(current_base_pose)[3:]  # Get rotation angles
        rz_deg = math.degrees(rz_rad)  # Convert Z-axis rotation to degrees
        return f"Current base position: X={current_position[0]}, Y={current_position[1]}, Z={current_position[2]}, RotationZ={rz_deg} degrees"
    else:
        return "Error: Could not retrieve base position."


def validate_point_index(point_index, points_list) -> bool:
    """
    Validate whether the point index is within the bounds of the points list.

    :param point_index: The index of the point to check.
    :param points_list: The list of points.
    :return: True if the index is valid, False otherwise.
    """
    return 0 <= point_index < len(points_list)


# Function to transform Rhino Z-axis values for RoboDK
def rhino_to_robodk_coordinates(point):
    """
    Transform a Rhino point to RoboDK-compatible coordinates, ensuring correct height (Z) adjustment.
    
    :param point: A Rhino point (with X, Y, Z values).
    :return: Transformed X, Y, Z coordinates.
    """
    # Assuming that Rhino Z needs to map directly to RoboDK Z and no additional transformation is needed.
    # If a transformation is needed (for example, flipping the Z axis), apply it here.
    return point.X, point.Y, point.Z

# Main script logic
SuccessMessage = connect_to_robot(RobotName)  # Connect to the robot
if "Error" not in SuccessMessage:
    # Validate the point index
    if not validate_point_index(PointIndex, TablePoints):
        SuccessMessage = f"Error: Point index {PointIndex} is out of bounds."
    else:
        point = TablePoints[PointIndex]  # Get the point at the specified index
        x, y, z = rhino_to_robodk_coordinates(point)  # Transform Rhino coordinates to RoboDK coordinates

        # Set the base if SetBase is true, otherwise retrieve current base position
        if SetBase:
            rz_deg = RotationZ  # Get the rotation value for the base
            SuccessMessage = set_robot_base(robot, x, y, z, rz_deg)
            BasePosition = f"Base set at: X={x}, Y={y}, Z={z}, RotationZ={rz_deg} degrees"
        else:
            BasePosition = get_current_base_position(robot)
else:
    BasePosition = ""

# Output the messages
print(SuccessMessage)
print(BasePosition)
# ---------- end python_3_script ----------
python_3_script_2 = Python3Script(TablePoints=concatenate, RobotName=robot_2_2, PointIndex=data_dam_3, SetBase=Toggle(False), RotationZ=data_dam_4)  # -> out, BasePosition, SuccessMessage; inputs TablePoints: list of Point3d, PointIndex: Int32, RotationZ: Double
# ---------- python_3_script_2: Python ----------
import robolink as rl       
import robodk as rdk        
import Rhino.Geometry as rg 
import math                 
SuccessMessage = ""   
BasePosition = ""     
JointPoints = []      
JointLines = []       


RDK = rl.Robolink()
robot = RDK.Item(RobotName, rl.ITEM_TYPE_ROBOT)
if not robot.Valid():
    
    SuccessMessage = f"Error: Could not find robot '{RobotName}' in RoboDK."
else:
    
    SuccessMessage = f"Connected to robot '{RobotName}' in RoboDK."

    
    if PointIndex >= len(TablePoints) or PointIndex < 0:
        SuccessMessage = f"Error: Point index {PointIndex} is out of bounds."
    else:
        
        point = TablePoints[PointIndex]
        
        
        x = float(point.X)
        y = float(point.Y)
        z = float(point.Z)
        
        
        if SetBase:
           

            
            rz_deg = RotationZ  

            
            rz_rad = math.radians(rz_deg)

           
            rotation_matrix = rdk.rotz(rz_rad)

           
            translation_matrix = rdk.transl(x, y, z)

            
            base_pose = translation_matrix * rotation_matrix

            # === End of Code for RotationZ ===

            # Get the robot's base (parent item in RoboDK)
            robot_base = robot.Parent()

            # Check if robot base is valid before setting pose
            if robot_base.Valid():
                # Set the robot base pose in RoboDK
                robot_base.setPose(base_pose)

                
                BasePosition = f"Base set at: X={x}, Y={y}, Z={z}, RotationZ={rz_deg} degrees"
                SuccessMessage = f"Robot '{RobotName}' base set at Point {PointIndex} with RotationZ={rz_deg} degrees successfully."
            else:
                
                SuccessMessage = "Error: Could not find or access the robot base."
                BasePosition = ""
        else:
            
            robot_base = robot.Parent()
            if robot_base.Valid():
                
                current_base_pose = robot_base.Pose()
                # Extract the translation components (position)
                current_position = current_base_pose.Pos()
                # Extract rotation angles around X, Y, Z axes (in radians)
                rx_rad, ry_rad, rz_rad = rdk.pose_2_xyzrpy(current_base_pose)[3:]  # Angles in radians
                # Convert rotation around Z-axis from radians to degrees
                rz_deg = math.degrees(rz_rad)
                # Update the BasePosition output with current position and rotation
                BasePosition = f"Current base position: X={current_position[0]}, Y={current_position[1]}, Z={current_position[2]}, RotationZ={rz_deg} degrees"
            else:
                # If robot base is not valid, update the BasePosition output
                BasePosition = "Error: Could not retrieve base position."
# ---------- end python_3_script_2 ----------
python_3_script_3 = Python3Script(TablePoints=tablepointscomau_2, RobotName=robot_3_2, PointIndex=data_dam_5, SetBase=Toggle(False), RotationZ=data_dam_6)  # -> out, BasePosition, SuccessMessage; inputs TablePoints: list of Point3d, PointIndex: Int32, RotationZ: Double; same code as python_3_script
panel_2 = Panel(python_3_script.BasePosition)
panel_3 = Panel(python_3_script.SuccessMessage)
panel_4 = Panel(python_3_script_2.BasePosition)
panel_5 = Panel(python_3_script_2.SuccessMessage)
panel_6 = Panel(python_3_script_3.BasePosition)
panel_7 = Panel(python_3_script_3.SuccessMessage)

robot_1_3 = RemoteReceiver(robot_1)
robot_2_3 = RemoteReceiver(robot_2)
robot_3_3 = RemoteReceiver(robot_3)
ur5_setup = Python3Script(RobotName=robot_1_3)  # -> out, RobotPosition, X_Axis, Y_Axis, Z_Axis, JointPoints, JointLines, SuccessMessage
# ---------- ur5_setup: Python ----------
import robolink as rl  # RoboDK API
import robodk as rdk
import Rhino.Geometry as rg
import math
import numpy as np

# === Inputs ===
# RobotName: Name of the robot in RoboDK (e.g., "UR5")

# Initialize outputs
RobotPosition = None
X_Axis = None
Y_Axis = None
Z_Axis = None
JointPoints = []
JointLines = []
SuccessMessage = ""

# Initialize RoboDK connection
RDK = rl.Robolink()

# Get the robot by name
robot = RDK.Item(RobotName, rl.ITEM_TYPE_ROBOT)

if not robot.Valid():
    SuccessMessage = f"Error: Could not find {RobotName} in RoboDK."
else:
    SuccessMessage = f"Connected to {RobotName} in RoboDK."

    # Get the robot's base pose
    robot_base = robot.Parent()
    if robot_base.Valid():
        base_pose = robot_base.Pose()
    else:
        base_pose = rdk.Mat()

    # Get the robot's current joint angles (degrees)
    joints_deg = robot.Joints().list()
    # Convert joint angles to radians
    joints_rad = [math.radians(angle) for angle in joints_deg]

    # UR5 standard DH parameters (in millimeters)
    d1 = 89.159
    a2 = -425.00
    a3 = -392.25
    d4 = 109.15
    d5 = 94.65
    d6 = 82.3

    alpha = [math.pi/2, 0, 0, math.pi/2, -math.pi/2, 0]
    a = [0, a2, a3, 0, 0, 0]
    d = [d1, 0, 0, d4, d5, d6]
    theta = [
        joints_rad[0],
        joints_rad[1],
        joints_rad[2],
        joints_rad[3],
        joints_rad[4],
        joints_rad[5],
    ]

    # Initialize the base transformation matrix
    T_base = np.array(base_pose.rows)
    # Ensure T_base is a 4x4 matrix
    if T_base.shape != (4, 4):
        SuccessMessage += " Error: Base pose matrix is not 4x4."
    else:
        # Initialize the transformation matrix
        T = T_base

        # Initialize joint positions list
        JointPoints = []

        # Store transformation matrices for each joint
        T_matrices = []

        for i in range(6):  # Six joints
            # DH parameters for current joint
            ai = a[i]
            alphai = alpha[i]
            di = d[i]
            thetai = theta[i]

            # Compute transformation matrix using DH parameters
            cos_theta = math.cos(thetai)
            sin_theta = math.sin(thetai)
            cos_alpha = math.cos(alphai)
            sin_alpha = math.sin(alphai)

            T_joint = np.array([
                [cos_theta, -sin_theta * cos_alpha,  sin_theta * sin_alpha, ai * cos_theta],
                [sin_theta,  cos_theta * cos_alpha, -cos_theta * sin_alpha, ai * sin_theta],
                [0,          sin_alpha,              cos_alpha,             di],
                [0,          0,                      0,                     1]
            ])

            # Update the overall transformation matrix
            T = np.dot(T, T_joint)

            # Save the transformation matrix for this joint
            T_matrices.append(T.copy())

            # Extract the position of the current joint
            position = T[:3, 3]

            # No conversion needed since we're working in millimeters
            joint_point = rg.Point3d(position[0], position[1], position[2])
            JointPoints.append(joint_point)

        # Create lines connecting the joints
        JointLines = []
        for i in range(1, len(JointPoints)):
            line = rg.Line(JointPoints[i - 1], JointPoints[i])
            JointLines.append(line)

        # Optionally, connect the base to the first joint
        if JointPoints:
            base_position = T_base[:3, 3]
            base_point = rg.Point3d(base_position[0], base_position[1], base_position[2])
            line = rg.Line(base_point, JointPoints[0])
            JointLines.insert(0, line)

        # Fetch the robot's pose relative to its base
        robot_pose = robot.Pose()

        # Compute the absolute pose of the TCP in the world coordinate system
        absolute_pose = base_pose * robot_pose

        # Extract position from the absolute pose
        position = absolute_pose.Pos()  # [x, y, z]

        # Create Rhino point for the robot's TCP position
        RobotPosition = rg.Point3d(position[0], position[1], position[2])

        # Extract orientation vectors from the rotation matrix of the absolute pose
        x_vector = rg.Vector3d(absolute_pose[0,0], absolute_pose[1,0], absolute_pose[2,0])
        y_vector = rg.Vector3d(absolute_pose[0,1], absolute_pose[1,1], absolute_pose[2,1])
        z_vector = rg.Vector3d(absolute_pose[0,2], absolute_pose[1,2], absolute_pose[2,2])

        # Scale vectors for visualization purposes
        scale_factor = 200  # Adjust as needed
        x_vector *= scale_factor
        y_vector *= scale_factor
        z_vector *= scale_factor

        # Create lines representing the robot's TCP axes
        X_Axis = rg.Line(RobotPosition, x_vector)
        Y_Axis = rg.Line(RobotPosition, y_vector)
        Z_Axis = rg.Line(RobotPosition, z_vector)

        # Optionally, connect the last joint to the TCP
        if JointPoints and RobotPosition:
            line = rg.Line(JointPoints[-1], RobotPosition)
            JointLines.append(line)
# ---------- end ur5_setup ----------
ur5_setup_2 = Python3Script(RobotName=robot_2_3)  # -> out, RobotPosition, X_Axis, Y_Axis, Z_Axis, JointPoints, JointLines, SuccessMessage; disabled; same code as ur5_setup
python_3_script_4 = Python3Script(RobotName=robot_3_3)  # -> X_Axis, Y_Axis, Z_Axis, RobotPosition, JointPoints, JointLines
# ---------- python_3_script_4: Python ----------
import robolink as rl  # RoboDK API
import robodk as rdk
import Rhino.Geometry as rg
import math
import numpy as np

# === Inputs ===
# RobotName: Name of the robot in RoboDK (e.g., "COMAU NJ 60-2.2")

# Initialize outputs
RobotPosition = None
X_Axis = None
Y_Axis = None
Z_Axis = None
JointPoints = []
JointLines = []
SuccessMessage = ""

# Initialize RoboDK connection
RDK = rl.Robolink()

# Get the robot by name
robot = RDK.Item(RobotName, rl.ITEM_TYPE_ROBOT)

if not robot.Valid():
    SuccessMessage = f"Error: Could not find {RobotName} in RoboDK."
else:
    SuccessMessage = f"Connected to {RobotName} in RoboDK."

    # Get the robot's base pose
    robot_base = robot.Parent()
    if robot_base.Valid():
        base_pose = robot_base.Pose()
    else:
        base_pose = rdk.Mat()

    # Get the robot's current joint angles (degrees)
    joints_deg = robot.Joints().list()
    # Convert joint angles to radians
    joints_rad = [math.radians(angle) for angle in joints_deg]

    # COMAU NJ 60-2.2 DH parameters (in millimeters and radians)
    d1 = 740
    a2 = 600
    a3 = 1200
    d4 = 1350
    d6 = 260

    # DH parameters for COMAU NJ 60-2.2
    alpha = [math.pi/2, 0, 0, math.pi/2, -math.pi/2, 0]
    a = [0, a2, a3, 0, 0, 0]
    d = [d1, 0, 0, d4, 0, d6]
    theta = [
        joints_rad[0],
        joints_rad[1],
        joints_rad[2],
        joints_rad[3],
        joints_rad[4],
        joints_rad[5],
    ]

    # Initialize the base transformation matrix
    T_base = np.array(base_pose.rows)
    # Ensure T_base is a 4x4 matrix
    if T_base.shape != (4, 4):
        SuccessMessage += " Error: Base pose matrix is not 4x4."
    else:
        # Initialize the transformation matrix
        T = T_base

        # Initialize joint positions list
        JointPoints = []

        # Store transformation matrices for each joint
        T_matrices = []

        for i in range(6):  # Six joints
            # DH parameters for current joint
            ai = a[i]
            alphai = alpha[i]
            di = d[i]
            thetai = theta[i]

            # Compute transformation matrix using DH parameters
            cos_theta = math.cos(thetai)
            sin_theta = math.sin(thetai)
            cos_alpha = math.cos(alphai)
            sin_alpha = math.sin(alphai)

            T_joint = np.array([
                [cos_theta, -sin_theta * cos_alpha,  sin_theta * sin_alpha, ai * cos_theta],
                [sin_theta,  cos_theta * cos_alpha, -cos_theta * sin_alpha, ai * sin_theta],
                [0,          sin_alpha,              cos_alpha,             di],
                [0,          0,                      0,                     1]
            ])

            # Update the overall transformation matrix
            T = np.dot(T, T_joint)

            # Save the transformation matrix for this joint
            T_matrices.append(T.copy())

            # Extract the position of the current joint
            position = T[:3, 3]

            # No conversion needed since we're working in millimeters
            joint_point = rg.Point3d(position[0], position[1], position[2])
            JointPoints.append(joint_point)

        # Create lines connecting the joints
        JointLines = []
        for i in range(1, len(JointPoints)):
            line = rg.Line(JointPoints[i - 1], JointPoints[i])
            JointLines.append(line)

        # Optionally, connect the base to the first joint
        if JointPoints:
            base_position = T_base[:3, 3]
            base_point = rg.Point3d(base_position[0], base_position[1], base_position[2])
            line = rg.Line(base_point, JointPoints[0])
            JointLines.insert(0, line)

        # Fetch the robot's pose relative to its base
        robot_pose = robot.Pose()

        # Compute the absolute pose of the TCP in the world coordinate system
        absolute_pose = base_pose * robot_pose

        # Extract position from the absolute pose
        position = absolute_pose.Pos()  # [x, y, z]

        # Create Rhino point for the robot's TCP position
        RobotPosition = rg.Point3d(position[0], position[1], position[2])

        # Extract orientation vectors from the rotation matrix of the absolute pose
        x_vector = rg.Vector3d(absolute_pose[0,0], absolute_pose[1,0], absolute_pose[2,0])
        y_vector = rg.Vector3d(absolute_pose[0,1], absolute_pose[1,1], absolute_pose[2,1])
        z_vector = rg.Vector3d(absolute_pose[0,2], absolute_pose[1,2], absolute_pose[2,2])

        # Scale vectors for visualization purposes
        scale_factor = 200  # Adjust as needed
        x_vector *= scale_factor
        y_vector *= scale_factor
        z_vector *= scale_factor

        # Create lines representing the robot's TCP axes
        X_Axis = rg.Line(RobotPosition, rg.Point3d(RobotPosition.X + x_vector.X, RobotPosition.Y + x_vector.Y, RobotPosition.Z + x_vector.Z))
        Y_Axis = rg.Line(RobotPosition, rg.Point3d(RobotPosition.X + y_vector.X, RobotPosition.Y + y_vector.Y, RobotPosition.Z + y_vector.Z))
        Z_Axis = rg.Line(RobotPosition, rg.Point3d(RobotPosition.X + z_vector.X, RobotPosition.Y + z_vector.Y, RobotPosition.Z + z_vector.Z))

        # Optionally, connect the last joint to the TCP
        if JointPoints and RobotPosition:
            line = rg.Line(JointPoints[-1], RobotPosition)
            JointLines.append(line)
# ---------- end python_3_script_4 ----------

# ----
# Real-Time Visualization
panel_8 = Panel(ur5_setup.Z_Axis)
panel_9 = Panel(ur5_setup.JointLines)
panel_10 = Panel(ur5_setup.SuccessMessage)
panel_11 = Panel(ur5_setup.RobotPosition)
panel_12 = Panel(ur5_setup.X_Axis)
panel_13 = Panel(ur5_setup.Y_Axis)
panel_14 = Panel(ur5_setup.JointPoints)

list_item = ListItem(List=[python_3_script_4.X_Axis, ur5_setup.X_Axis], Index=0, Wrap=True)  # -> Item, Item1
list_item_2 = ListItem(List=[ur5_setup.Y_Axis, python_3_script_4.Y_Axis], Index=0, Wrap=True)  # -> Item, Item1
list_item_3 = ListItem(List=[ur5_setup.Z_Axis, python_3_script_4.Z_Axis], Index=0, Wrap=True)  # -> Item, Item1

custom_preview_lineweights = CustomPreviewLineweights(
    Geometry=ur5_setup.JointLines,
    Shader=ColourSwatch(SwatchColor=RGB(26, 26, 26)),
    Thickness=Slider(2, range=0..200),
    Absolute=False)

colour_swatch = ColourSwatch(SwatchColor=RGB(255, 0, 0))
colour_swatch_2 = ColourSwatch(SwatchColor=RGB(82, 255, 3))
colour_swatch_3 = ColourSwatch(SwatchColor=RGB(17, 101, 145))
entwine = Entwine(
    Branch00=list_item.Item,
    Branch01=list_item_2.Item,
    Branch02=list_item_3.Item,
    Branch03=list_item.Item1,
    Branch04=list_item_2.Item1,
    Branch05=list_item_3.Item1,
    FlattenInputs=True)
entwine_2 = Entwine(
    Branch00=colour_swatch,
    Branch01=colour_swatch_2,
    Branch02=colour_swatch_3,
    Branch03=colour_swatch,
    Branch04=colour_swatch_2,
    Branch05=colour_swatch_3,
    Branch06=colour_swatch,
    Branch07=colour_swatch_2,
    Branch08=colour_swatch_3,
    FlattenInputs=True)
custom_preview_lineweights_2 = CustomPreviewLineweights(Geometry=entwine, Shader=entwine_2, Thickness=Slider(3, range=0..10), Absolute=False)

list_item_4 = ListItem(List=[python_3_script_4.RobotPosition, ur5_setup.RobotPosition], Index=0, Wrap=True)  # -> Item, Item1
point_3 = Point([list_item_4.Item, list_item_4.Item1])
sphere = Sphere(Base=point_3, Radius=Slider(20, range=0..100))
custom_preview_2 = CustomPreview(Geometry=sphere, Material=ColourSwatch(SwatchColor=RGB(117, 117, 117)))

planes = RemoteReceiver()
robot_1_4 = RemoteReceiver(robot_1)
plane = Plane(planes)
panel_15 = Panel(planes)
python_3_script_5 = Python3Script(RobotName=robot_1_4, UpdateRoboDK=Toggle(False), PlanesList=plane)  # -> out, SuccessMessage, TargetPoses, Program, TCPOrientations, PlaneExtra; inputs PlanesList: list of Plane
# ---------- python_3_script_5: Python ----------
import robolink as rl    # RoboDK API for controlling and communicating with RoboDK  
import robodk as rdk     # RoboDK tools, such as matrix operations and other utilities
import Rhino.Geometry as rg  # Import Rhino.Geometry module as rg
import math

# === Inputs ===
# RobotName: Name of the robot in RoboDK (e.g., "UR5")
# UpdateRoboDK: Boolean toggle to execute the script and update RoboDK when True
# PlanesList: List of Rhino Plane objects (each plane contains both target point and orientation)

# Initialize outputs
SuccessMessage = ""
TargetPoses = []  # List of converted poses
Program = ""
TCPOrientations = []
TargetPointCoordinates = []
PlaneExtra = []  # Unreachable planes for other robots to attempt

# Function to convert Rhino Plane to RoboDK Pose (4x4 matrix)
def plane_to_pose(plane):
    """Converts a Rhino plane to a RoboDK pose (4x4 matrix)."""
    pose = rdk.Mat([
        [plane.XAxis.X, plane.YAxis.X, plane.ZAxis.X, plane.OriginX],
        [plane.XAxis.Y, plane.YAxis.Y, plane.ZAxis.Y, plane.OriginY],
        [plane.XAxis.Z, plane.YAxis.Z, plane.ZAxis.Z, plane.OriginZ],
        [0, 0, 0, 1]
    ])
    return pose

# Function to format the orientation of the TCP as strings for easy reporting
def format_tcp_orientation(plane, milestone):
    """Formats the TCP orientation (X, Y, Z axes) for a given milestone."""
    x_axis = plane.XAxis
    y_axis = plane.YAxis
    z_axis = plane.ZAxis
    return f"TCP orientation at {milestone}:\n  X-axis: {x_axis}\n  Y-axis: {y_axis}\n  Z-axis: {z_axis}"

# Function to format the target point coordinates {x, y, z} for reporting
def format_target_coordinates(plane, milestone):
    """Formats the target point coordinates as a string for a given milestone."""
    return f"{plane.OriginX}, {plane.OriginY}, {plane.OriginZ}"

# Check required inputs before proceeding
if not RobotName:
    SuccessMessage = "Error: RobotName is required."
elif not PlanesList or not isinstance(PlanesList, list):
    SuccessMessage = "Error: PlanesList must be a list of Rhino Plane objects."
elif any(not isinstance(plane, rg.Plane) for plane in PlanesList):
    SuccessMessage = "Error: All elements in PlanesList must be Rhino Plane objects."
elif UpdateRoboDK is None:
    SuccessMessage = "Error: UpdateRoboDK toggle is required."
elif not UpdateRoboDK:
    SuccessMessage = "UpdateRoboDK is set to False. No action taken."
else:
    # Connect to RoboDK only if UpdateRoboDK is True
    RDK = rl.Robolink()  # Initialize RoboDK connection
    SuccessMessage = "Connected to RoboDK."
    
    # Retrieve the robot by name
    robot = RDK.Item(RobotName, rl.ITEM_TYPE_ROBOT)
    
    if not robot.Valid():
        SuccessMessage += f"\nError: Could not find {RobotName} in RoboDK."
    else:
        SuccessMessage += f"\nFound robot '{robot.Name()}' in RoboDK."
        
        # Get the robot's base and tool
        robot_base = robot.Parent()
        tool = robot.getLink(rl.ITEM_TYPE_TOOL)
        
        # Check if the robot base and tool are valid
        if not robot_base.Valid():
            SuccessMessage += "\nError: Robot's base not found."
        else:
            SuccessMessage += f"\nRobot base: {robot_base.Name()}"

        if not tool.Valid():
            SuccessMessage += "\nError: Robot's tool not found."
        else:
            SuccessMessage += f"\nRobot tool: {tool.Name()}"

        # Enable collision detection in RoboDK
        RDK.setCollisionActive(1)

        if not robot_base.Valid() or not tool.Valid():
            SuccessMessage += "\nCannot proceed without valid base and tool."
        else:
            # Set the robot to its home position before starting
            robot.MoveJ(robot.JointsHome())

            # Get the robot base frame pose
            base_pose = robot_base.Pose()

            # Create a new program
            SuccessMessage += "\nCreating program in RoboDK..."
            program_name = "MoveThroughPlanesProgram"
            program = RDK.AddProgram(program_name, robot)
            program.setFrame(robot_base)  # Set the base frame of the robot
            program.setTool(tool)  # Set the tool of the robot

            # Process each plane in PlanesList independently
            for idx, plane in enumerate(PlanesList):
                # Convert plane to RoboDK pose
                target_pose_robot = plane_to_pose(plane)

                # Adjust the target pose with respect to the robot's base frame
                base_pose_inv = base_pose.inv()
                target_pose_relative = base_pose_inv * target_pose_robot

                # Check if the target is reachable
                try:
                    # Check if robot can reach the target pose (simulating this step)
                    robot.MoveJ(target_pose_relative, False)  # Simulation mode, does not execute actual motion
                    SuccessMessage += f"\nPlane {idx+1} reachable."
                except Exception as e:
                    # If an error occurs, consider the target unreachable
                    SuccessMessage += f"\nPlane {idx+1} unreachable. Error: {str(e)}"
                    PlaneExtra.append(plane)  # Add unreachable plane to PlaneExtra for another robot
                    continue  # Skip this plane and move to the next one

                # Store the pose
                TargetPoses.append(target_pose_relative)

                # Format TCP orientation and coordinates for reporting
                milestone = f"Plane {idx+1}"
                TCPOrientations.append(format_tcp_orientation(plane, milestone))
                TargetPointCoordinates.append(format_target_coordinates(plane, milestone))

                # Add the movement target in RoboDK
                target_name = f"Plane_{idx+1}"
                target = RDK.AddTarget(target_name, robot_base, robot)
                target.setAsCartesianTarget()
                target.setPose(target_pose_relative)

                # Add movements to the program independently
                program.MoveJ(target)  # Move to the target

            Program = program_name  # Assign the created program's name to the output
            SuccessMessage += f"\nProgram '{program_name}' created successfully."
# ---------- end python_3_script_5 ----------
panel_16 = Panel(python_3_script_5.SuccessMessage)
panel_17 = Panel(python_3_script_5.TargetPoses)
panel_18 = Panel(python_3_script_5.Program)
panel_19 = Panel(python_3_script_5.TCPOrientations)
panel_20 = Panel(python_3_script_5.PlaneExtra)

sphere_2 = Sphere(Base=ur5_setup.JointPoints, Radius=Slider(20.8, range=0..100))
custom_preview_3 = CustomPreview(Geometry=sphere_2, Material=ColourSwatch(SwatchColor=RGB(21, 201, 237)))
panel_21 = Panel("""J0
J1
J2
J3
J4
J5""")
panel_22 = Panel("""J0
J1
J2
J3
J4
J5""")
colour_swatch_4 = ColourSwatch(SwatchColor=RGB(255, 0, 0))

entwine_3 = Entwine(Branch00=list_item.Item, Branch01=list_item.Item1, FlattenInputs=True)
end_points = EndPoints(Curve=entwine_3)  # -> Start, End
text_tag = TextTag(Location=end_points.End, Text="x")

entwine_4 = Entwine(Branch00=list_item_2.Item, Branch01=list_item_2.Item1, FlattenInputs=True)
entwine_5 = Entwine(Branch00=list_item_3.Item, Branch01=list_item_3.Item1, FlattenInputs=True)
data = Data(sphere_2)

end_points_2 = EndPoints(Curve=entwine_4)  # -> Start, End
end_points_3 = EndPoints(Curve=entwine_5)  # -> Start, End
text_tag_2 = TextTag(Location=end_points_2.End, Text="y")
text_tag_3 = TextTag(Location=end_points_3.End, Text="z")

panel_23 = Panel(data)
area = Area(Geometry=data)  # -> Area, Centroid
scale = Scale(Geometry=sphere_2, Center=area.Centroid, Factor=Slider(1.73, range=0..3))  # -> Geometry, Transform; disabled
tree_branch = TreeBranch(Tree=area.Centroid, Path="{0;1}", MaintainPaths=True)  # -> flatten(Branch)
text_tag_4 = TextTag(Location=tree_branch, Text=panel_22, Colour=colour_swatch_4)

tree_branch_2 = TreeBranch(Tree=area.Centroid, Path="{0;0}", MaintainPaths=True)  # -> flatten(Branch)
panel_24 = Panel(tree_branch_2)

text_tag_5 = TextTag(Location=tree_branch_2, Text=panel_21, Colour=colour_swatch_4)
